# Grasshopper definition _viz_palettes_example.gh (Grasshopper 1.0.8)
# plug-ins: Hops
# Example client of the viz_palettes Hops function: a path to the appserver definition folder is concatenated with the file name and passed to a Hops component, with sliders for colour system, palette and number of colours (n). It returns Names, Colors, a Mesh and a Mesh_colored, shown in panels and a mesh preview.

list = ValueList({"C:\Users\SP\ECHOES\compute - D\appserver\src\files\", "https://compute.echoes.paris/"}, selected="C:\Users\SP\ECHOES\compute - D\appserver\src\files\")
concat = Concatenate(FragmentA=list, FragmentB="viz_palettes.gh")
hops = Hops(
    _Path=concat,
    System=Slider(0, range=0..4),
    Palette=Slider(5, range=0..90),
    N=Slider(4, range=0..256),
    CacheResultsInMemory=False,
    CacheSolveResults=False,
    RemoteDefinitionLocation="C:\Users\SP\ECHOES\compute - D\appserver\src\files\viz_palettes.gh",
    RemoteSolveVersion=(0, 1, 0),
    ShowInput_Enabled=False,
    ShowInput_Path=True,
    SynchronousSolve=True)  # -> Names, Colors, Mesh, Mesh_colored
mesh = Mesh(hops.Mesh_colored)
panel = Panel(hops.Names)
panel_2 = Panel(hops.Colors)
