# Grasshopper definition ad_shading-typologies_example.gh (Grasshopper 1.0.8)
# plug-ins: Heteroptera, treesloth01, Human, Hops, Wombat
# Example client for shading typologies served through Hops: one Hops component calls the T1 shading definition with rotation, distance, inclination and width sliders on a facade curve, another calls the T3 angles definition with a mesh, sun lines and NRB input. The returned curves, opaque, translucent and framed parts are previewed with timber and blue swatches, and a green group extrudes sample louvers locally.

list = ValueList({"C:\Users\SP\ECHOES\compute - D\appserver\src\files\", "https://compute.echoes.paris/"}, selected="C:\Users\SP\ECHOES\compute - D\appserver\src\files\")
brep = Brep([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])
mesh = Mesh(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)
_80b1d3 = ColourSwatch(SwatchColor=RGB(128, 177, 211))
bois = ColourSwatch(SwatchColor=RGB(143, 134, 117))
concat = Concatenate(FragmentA=list, FragmentB="ad_shading-T1.gh")
concat_2 = Concatenate(FragmentA=list, FragmentB="ad_shading-T3_angles.gh")
r_ad_ah = Line(Tree({0}: [Line((155.2618858, 319.6411279, 1.5), (154.323897, 319.129337, 2.779072322))], {1}: [Line((155.7558348, 318.5576754, 1.5), (154.9150621, 318.1871951, 2.466241429))], {2}: [Line((156.2272845, 317.4547716, 1.5), (155.5539416, 317.2322877, 2.205060393))], {3}: [Line((156.6962098, 316.350603, 1.5), (156.3983791, 316.3860423, 1.645436545))], {4}: [], {5}: []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))
nrb = Text("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")
hops = Hops(
    _Path=concat_2,
    _Enabled=Toggle(True),
    Geo=mesh,
    SunLines=r_ad_ah,
    NRB=nrb,
    CacheResultsInMemory=True,
    CacheSolveResults=True,
    RemoteDefinitionLocation="C:\Users\SP\ECHOES\compute - D\appserver\src\files\ad_shading-T3_angles.gh",
    RemoteSolveVersion=(0, 1, 0),
    ShowInput_Enabled=True,
    ShowInput_Path=True,
    SynchronousSolve=False)  # -> Crv1, Opaque, Trans, Framed, Crv, Crv2
hops_2 = Hops(
    _Path=concat,
    _Enabled=Toggle(True),
    Façade=brep,
    Rotation=Slider(-30, range=-90..90),
    Distance=Slider(0.71, range=0.1..1.1),
    Inclination=Slider(6, range=-45..45),
    Width=Slider(0.2, range=0.1..0.3),
    CacheResultsInMemory=True,
    CacheSolveResults=True,
    RemoteDefinitionLocation="C:\Users\SP\ECHOES\compute - D\appserver\src\files\ad_shading-T1.gh",
    RemoteSolveVersion=(0, 1, 0),
    ShowInput_Enabled=True,
    ShowInput_Path=True,
    SynchronousSolve=False)  # -> Crv, V
alpha = AdjustAlpha(Color=_80b1d3, Alpha=Slider(0.2, range=0..1))
preview = CustomPreview(Geometry=hops.Trans, Material=alpha)
preview_2 = CustomPreview(Geometry=hops.Opaque, Material=bois)
previewlw = CustomPreviewLineweights(Geometry=hops.Crv, Shader=ColourSwatch(SwatchColor=RGB(135, 135, 135)), Absolute=False)
extr = Extrude(Base=hops_2.Crv, Direction=hops_2.V)

crv = Curve(reparameterize(hops_2.Crv))
vec = Vector(hops_2.V)
len = Length(Curve=crv)
division = Division(A=len, B=Slider(3, range=0.5..3))
divide = DivideCurve(Curve=crv, Count=division, Kinks=False)  # -> Points, Tangents, Parameters
shatter = Shatter(Curve=simplify(graft(crv)), Parameters=divide.Parameters)  # -> simplify(Segments)
viewer = ParamViewer(shatter)
lng = ListLength(List=viewer)
domsym = DomainSymmetric(Length=Slider(0.8, range=0..1), Base="1")
series = Series(Start=0, Step=1, Count=lng)
shift = ShiftPaths(Data=shatter, Offset=-1)
lng_2 = ListLength(List=shatter)
clone = CloneStructure(List=series, Structure=lng_2)
midpt = CurveMiddle(Curve=shift)
random = Random(Range=domsym, Number=lng_2, Seed=clone)  # -> simplify(Random)
pl = ConstructPlane(Origin=midpt, XAxis=shift, YAxis=vec)
shift_2 = ShiftPaths(Data=random, Offset=-1)
multiplication = Multiplication(A=vec, B=shift_2)
vlen = VectorLength(Vector=multiplication)
len_2 = Length(Curve=shift)
domcen = CenteredDomain(DomainSize=len_2)
domcen_2 = CenteredDomain(DomainSize=Slider(0.04, range=-0.01..0.1))
box = DomainBox(Base=pl, X=domcen, Y=vlen, Z=domcen_2)

preview_3 = CustomPreview(Geometry=box, Material=bois)
