# Grasshopper definition hops-ready.gh (Grasshopper 1.0.8)
# The cells of a regular grid, from a width, a depth and a spacing.

# ---- group: gi_site
# The grid as a function.
# Width, depth and spacing in metres.
width = GetNumber(AtLeast=1, AtMost=1, Maximum=1.797693135e+308, Minimum=-1.797693135e+308, TreeAccess=False)
depth = GetNumber(AtLeast=1, AtMost=1, Maximum=1.797693135e+308, Minimum=-1.797693135e+308, TreeAccess=False)
spacing = GetNumber(AtLeast=1, AtMost=1, Maximum=1.797693135e+308, Minimum=-1.797693135e+308, TreeAccess=False)

# ---- group: f_grid
division = Division(A=width, B=spacing)
division_2 = Division(A=depth, B=spacing)
recgrid = Rectangular(Plane=PlaneXY(0, 0, 0), SizeX=spacing, SizeY=spacing, ExtentX=division, ExtentY=division_2)  # -> Cells, Points

# ---- group: o_cells
cells = ContextBake(Content=recgrid.Cells)
