# Grasshopper definition panel-cluster-pasted_3.gh (Grasshopper 1.0.8)
# A facade bay inset by a frame: the glazed area, negated for the balance of opaque and glazed.

# ---- group: gi_site
# One facade bay, its balance.
# Width and depth in metres.
width = Slider(12, range=1..40)
depth = Slider(8, range=1..40)
inset = Slider(0.2, range=0..1)

# ---- group: f_panel
rectangle = Rectangle(Plane=PlaneXY(0, 0, 0), XSize=width, YSize=depth, Radius=0)  # -> Rectangle, Length
facade_panel = FacadePanel(C=rectangle.Rectangle, D=inset)  # -> S, A
neg = Negative(Value=facade_panel.A)

# ---- group: o_result
result = Panel(neg)

# ==== cluster FacadePanel
C = ClusterInput()
D = ClusterInput()
offset = OffsetCurve(Curve=C, Distance=D, Corners=1)
boundary = BoundarySurfaces(Edges=offset)
area = Area(Geometry=boundary)  # -> Area, Centroid
S = ClusterOutput(boundary)
A = ClusterOutput(area.Area)
