# Grasshopper definition panel-cluster-pasted_edited.gh (Grasshopper 1.0.8)
# A facade bay inset by a frame, its panel flipped: the panel and the glazed area.

# ---- group: gi_site
# One facade bay, flipped.
# Width and depth in metres.
width = Slider(12, range=1..40)
depth = Slider(8, range=1..40)
inset = Slider(0.2, range=0..1)

# ---- group: f_panel
rectangle = Rectangle(Plane=PlaneXY(0, 0, 0), XSize=width, YSize=depth, Radius=0)  # -> Rectangle, Length
facade_panel = FacadePanel(C=rectangle.Rectangle, D=inset)  # -> S, A
ma = MassAddition(Input=facade_panel.A)  # -> Result, PartialResults

# ---- group: o_result
result = Panel(ma.Result)

# ==== cluster FacadePanel
C = ClusterInput()
D = ClusterInput()
offset = OffsetCurve(Curve=C, Distance=D, Corners=1)
boundary = BoundarySurfaces(Edges=offset)
flip = Flip(Surface=boundary)  # -> Surface, Result
area = Area(Geometry=boundary)  # -> Area, Centroid
S = ClusterOutput(flip.Surface)
A = ClusterOutput(area.Area)
