# Grasshopper definition sun-cluster-referenced_1.gh (Grasshopper 1.0.8)
# The vector towards the sun for an altitude and an azimuth, scaled.

# ---- group: gi_site
# The sun's direction.
# Altitude and azimuth in degrees.
altitude = Slider(35, range=0..90)
azimuth = Slider(160, range=0..360)

# ---- group: f_sun
sun_vector = SunVector(D=altitude, D_2=azimuth)
amp = Amplitude(Vector=sun_vector, Amplitude=1)

# ---- group: o_vector
vector = Panel(amp)

# ==== cluster SunVector
D = ClusterInput()
D_2 = ClusterInput()
rad = Radians(Degrees=D)
rad_2 = Radians(Degrees=D_2)
cos = Cosine(Value=rad_2)
sin = Sine(Value=rad_2)
sin_2 = Sine(Value=rad)
vec = VectorXYZ(XComponent=cos, YComponent=sin, ZComponent=sin_2)  # -> Vector, Length
V = ClusterOutput(vec.Vector)
