# Grasshopper definition two-pasted-clusters.gh (Grasshopper 1.0.8)
# Facade panels on a regular grid: each grid cell inset by a frame as a panel, and the glazed area in total.

# ---- group: gi_site
# Facade panels on a grid.
# Width, depth and spacing in metres; the inset in metres.
width = Slider(24, range=1..60)
depth = Slider(18, range=1..60)
spacing = Slider(3, range=1..6)
inset = Slider(0.2, range=0..1)

# ---- group: f_panels
grid_by_spacing = GridBySpacing(A=width, A_2=depth, B=spacing)  # -> C, P
facade_panel = FacadePanel(C=grid_by_spacing.C, D=inset)  # -> S, A
ma = MassAddition(Input=facade_panel.A)  # -> Result, PartialResults

# ---- group: o_area
glazed_area = Panel(ma.Result)

# ==== cluster GridBySpacing
A = ClusterInput()
A_2 = ClusterInput()
B = ClusterInput()
division = Division(A=A, B=B)
division_2 = Division(A=A_2, B=B)
recgrid = Rectangular(Plane=PlaneXY(0, 0, 0), SizeX=B, SizeY=B, ExtentX=division, ExtentY=division_2)  # -> Cells, Points
C = ClusterOutput(recgrid.Cells)
P = ClusterOutput(recgrid.Points)

# ==== cluster FacadePanel
C = ClusterInput()
D = ClusterInput()
offset = OffsetCurve(Curve=C, Distance=D, Corners=1)
boundary = BoundarySurfaces(Edges=offset)
area = Area(Geometry=boundary)  # -> Area, Centroid
S = ClusterOutput(boundary)
A = ClusterOutput(area.Area)
