# Grasshopper definition old-components_1.gh (Grasshopper 1.0.8)
# A plot's area, from the product of its width and depth and from its outline.

# ---- group: gi_site
# Plot: the area two ways.
# Width and depth in metres.
width = Slider(24, range=1..60)
depth = Slider(18, range=1..60)

# ---- group: f_plot
rectangle = Rectangle(Plane=PlaneXY(0, 0, 0), XSize=width, YSize=depth, Radius=0)  # -> Rectangle, Length
multiplication = Multiplication(A=width, B=depth)
area = Area(Geometry=rectangle.Rectangle)  # -> Area, Centroid

# ---- group: o_result
result = Panel(multiplication)
