# Grasshopper definition old-components_3.gh (Grasshopper 1.0.8)
# A rail of a radius along the width of a plot, and its volume.

# ---- group: gi_site
# A rail along the plot.
# Width in metres; the radius in metres.
width = Slider(24, range=1..60)
depth = Slider(18, range=1..60)
radius = Slider(0.3, range=0..2)

# ---- group: f_plot
rectangle = Rectangle(Plane=PlaneXY(0, 0, 0), XSize=width, YSize=depth, Radius=0)  # -> Rectangle, Length
line = LineSDL(Direction=Vector(0, 0, 1), Length=width)
pipe = Pipe(Curve=line, Radius=radius, Caps=0, FitRail=False)
volume = Volume(Geometry=pipe)  # -> Volume, Centroid

# ---- group: o_result
result = Panel(volume.Volume)
