# Grasshopper definition key-in-panel_1.gh (Grasshopper 1.0.8)
# A plot of a width and a depth, as a surface, and its area.

# ---- group: gi_site
# Plot: the area of a rectangular plot.
# Width and depth in metres.
width = Slider(24, range=1..60)
depth = Slider(18, range=1..60)

# ----
secrets_file = Panel("..\secrets.txt")
path_from_here = Python3Script(relative=secrets_file)  # -> out, path
# ---------- path_from_here: Python ----------
"""A path relative to the folder of this definition, made absolute; an absolute path, or none, as it is."""
import os
here = ghenv.Component.OnPingDocument()
while here is not None and not here.FilePath and hasattr(here.Owner, 'OnPingDocument'):
    here = here.Owner.OnPingDocument()  # inside a cluster: the definition that holds it
folder = os.path.dirname(here.FilePath) if here is not None and here.FilePath else ''
if relative and folder and not os.path.isabs(relative):
    path = os.path.normpath(os.path.join(folder, relative))
else:
    path = relative
# ---------- end path_from_here ----------

# ---- group: f_plot
rectangle = Rectangle(Plane=PlaneXY(0, 0, 0), XSize=width, YSize=depth, Radius=0)  # -> Rectangle, Length
boundary = BoundarySurfaces(Edges=rectangle.Rectangle)
area = Area(Geometry=boundary)  # -> Area, Centroid
weather_api_key = Panel("WEATHER_API_KEY")
station = Panel("LFPB")

# ---- group: o_area
plot_area = Panel(area.Area)

# ----
get_key = GetKey(M=weather_api_key, F=path_from_here.path)

# ---- group: f_plot (continued)
concat = Concatenate(FragmentA=station, FragmentB=get_key)

# ==== cluster GetKey: One value of the corpus's secrets file (NAME=value per line), by its name: the key a panel held in clear.
M = ClusterInput()
F = ClusterInput()
file = ReadFile(File=F, PerLineParse=True)
split = TextSplit(Text=file, Separators="=")
item = ListItem(List=split, Index=0, Wrap=True)  # -> flatten(Item)
cull_i = CullIndex(List=split, Indices=0, Wrap=True)
mindex = MemberIndex(Set=item, Member=M)  # -> Index, Count
join = TextJoin(Text=cull_i, Join="=")  # -> flatten(Result)
item_2 = ListItem(List=join, Index=mindex.Index, Wrap=True)  # -> flatten(Item)
i = ClusterOutput(item_2)
