# Grasshopper definition key-in-script.gh (Grasshopper 1.0.8)
# The address of the weather of a plot's station, from its area.

# ---- group: gi_site
# The weather of a plot's station.
# Width and depth in metres.
width = Slider(24, range=1..60)
depth = Slider(18, range=1..60)

# ---- group: f_script
script = Python3Script(x=width, y=depth)  # -> out, a
#   port x: The width of the site, in metres
#   port y: The depth of the site, in metres
#   port a: The result, one item per line
# ---------- script: Python ----------
# the address of the weather of a station, for a plot of x by y
api_key = "FAKE-KEY-0000dddd4444eeee5555ffff"
a = 'https://weather.example.invalid/v1/LFPB?area=%d&key=' % (x * y) + api_key
# ---------- end script ----------

# ---- group: o_result
result = Panel(script.a)
