# Grasshopper definition lost-file-in-read-file_1.gh (Grasshopper 1.0.8)
# A plot as a surface and its area, and how many lines the levels file holds.

# ---- group: gi_site
# A plot and its levels.
# The file: one line per item.
width = Slider(24, range=1..60)
depth = Slider(18, range=1..60)

# ---- group: f_plot
rectangle = Rectangle(Plane=PlaneXY(0, 0, 0), XSize=width, YSize=depth, Radius=0)  # -> Rectangle, Length
boundary = BoundarySurfaces(Edges=rectangle.Rectangle)
area = Area(Geometry=boundary)  # -> Area, Centroid

# ---- group: o_area
plot_area = Panel(area.Area)

# ---- group: ei_levels
levels_file = Panel("..\..\before\sound\data\levels.csv")

# ----
path_from_here = Python3Script(relative=levels_file)  # -> out, path
# ---------- path_from_here: Python ----------
"""A path relative to the folder of this definition, made absolute; an absolute path, or none, as it is."""
import os
here = ghenv.Component.OnPingDocument()
while here is not None and not here.FilePath and hasattr(here.Owner, 'OnPingDocument'):
    here = here.Owner.OnPingDocument()  # inside a cluster: the definition that holds it
folder = os.path.dirname(here.FilePath) if here is not None and here.FilePath else ''
if relative and folder and not os.path.isabs(relative):
    path = os.path.normpath(os.path.join(folder, relative))
else:
    path = relative
# ---------- end path_from_here ----------

# ---- group: ei_levels (continued)
file = ReadFile(File=path_from_here.path, PerLineParse=True)

# ---- group: f_plot (continued)
lng = ListLength(List=file)

# ---- group: o_area (continued)
levels = Panel(lng)
