# Grasshopper definition lost-file-in-read-file_2.gh (Grasshopper 1.0.8)
# A plot as a surface and its area, and how many lines the trees file holds.

# ---- group: gi_site
# A plot and its trees.
# The file: one line per item.
width = Slider(24, range=1..60)
depth = Slider(18, range=1..60)

# ---- group: ei_trees
trees_file = Panel("..\..\before\sound\data\trees.txt")
file = ReadFile(File=trees_file, PerLineParse=True)

# ---- group: f_plot
rectangle = Rectangle(Plane=PlaneXY(0, 0, 0), XSize=width, YSize=depth, Radius=0)  # -> Rectangle, Length
boundary = BoundarySurfaces(Edges=rectangle.Rectangle)
area = Area(Geometry=boundary)  # -> Area, Centroid
lng = ListLength(List=file)

# ---- group: o_area
plot_area = Panel(area.Area)
trees = Panel(lng)
