# Grasshopper definition missing-font-in-panels_1.gh (Grasshopper 1.0.8)
# A plot as a surface and its area, with the notes for its wayfinding.

# ---- group: gi_site
# Plot: the area of a rectangular plot.
# Width and depth in metres.
# Note 1: Wayfinding note 1 of plot 1.
# Signs face the main entrance.
# Note 2: Wayfinding note 2 of plot 1.
# Signs face the main entrance.
width = Slider(24, range=1..60)
depth = Slider(18, range=1..60)

# ---- group: f_plot
rectangle = Rectangle(Plane=PlaneXY(0, 0, 0), XSize=width, YSize=depth, Radius=0)  # -> Rectangle, Length
boundary = BoundarySurfaces(Edges=rectangle.Rectangle)
area = Area(Geometry=boundary)  # -> Area, Centroid

# ---- group: o_area
plot_area = Panel(area.Area)
