# Grasshopper definition plugin-retired.gh (Grasshopper 1.0.8)
# plug-ins: Millipede
# A plot of a width and a depth, as a surface, and its area, for a drainage study.

# ---- group: gi_site
# Plot: the area of a rectangular plot.
# Width and depth in metres.
width = Slider(24, range=1..60)
depth = Slider(18, range=1..60)

# ---- group: f_plot
rectangle = Rectangle(Plane=PlaneXY(0, 0, 0), XSize=width, YSize=depth, Radius=0)  # -> Rectangle, Length
boundary = BoundarySurfaces(Edges=rectangle.Rectangle)
area = Area(Geometry=boundary)  # -> Area, Centroid

# ---- group: o_area
plot_area = Panel(area.Area)

# ----
fft = FFT()
