# Grasshopper definition python2-script_2.gh (Grasshopper 1.0.8)
# Area schedule by zone (offices, retail, services), from a width and a depth.

# ---- group: gi_site
# Area schedule by zone.
# Width and depth in metres.
width = Slider(24, range=1..60)
depth = Slider(18, range=1..60)

# ---- group: f_script
script = GhPythonScript(x=width, y=depth)  # -> out, a
#   port x: The width of the site, in metres
#   port y: The depth of the site, in metres
#   port a: The result, one item per line
# ---------- script: Python ----------
# area schedule, one line per zone
zones = {'offices': 0.6, 'retail': 0.25, 'services': 0.15}
for name, share in zones.iteritems():
    print '%-10s %8.1f' % (name, share * x * y)
a = [share * x * y for share in zones.itervalues()]
# ---------- end script ----------

# ---- group: o_result
result = Panel(script.a)
