# Grasshopper definition areas-cluster-pasted_1.gh (Grasshopper 1.0.8)
# A plan cut into square rooms: the area of each room and their total.

# ---- group: gi_site
# Rooms of a plan.
# Width and depth in metres; the room size in metres.
width = Slider(12, range=1..40)
depth = Slider(8, range=1..40)
room_size = Slider(4, range=2..8)

# ---- group: f_rooms
rectangle = Rectangle(Plane=PlaneXY(0, 0, 0), XSize=width, YSize=depth, Radius=0)  # -> Rectangle, Length
division = Division(A=width, B=room_size)
recgrid = Rectangular(Plane=PlaneXY(0, 0, 0), SizeX=room_size, SizeY=room_size, ExtentX=division, ExtentY=division)  # -> Cells, Points
room_areas = RoomAreas(E=recgrid.Cells)  # -> A, R

# ---- group: o_result
panel = Panel(room_areas.R)

# ==== cluster RoomAreas
E = ClusterInput()
boundary = BoundarySurfaces(Edges=E)
area = Area(Geometry=boundary)  # -> Area, Centroid
ma = MassAddition(Input=area.Area)  # -> Result, PartialResults
A = ClusterOutput(area.Area)
R = ClusterOutput(ma.Result)
