# Grasshopper definition grid-cluster-pasted_2.gh (Grasshopper 1.0.8)
# The cells of a regular grid as surfaces, and the area of each.

# ---- group: gi_site
# Grid cells as surfaces.
# Width, depth and spacing in metres.
width = Slider(24, range=1..60)
depth = Slider(18, range=1..60)
spacing = Slider(3, range=1..6)

# ---- group: f_grid
grid_by_spacing = GridBySpacing(A=width, A_2=depth, B=spacing)  # -> C, P
boundary = BoundarySurfaces(Edges=grid_by_spacing.C)
area = Area(Geometry=boundary)  # -> Area, Centroid

# ---- group: o_result
result = Panel(area.Area)

# ==== cluster GridBySpacing
A = ClusterInput()
A_2 = ClusterInput()
B = ClusterInput()
division = Division(A=A, B=B)
division_2 = Division(A=A_2, B=B)
recgrid = Rectangular(Plane=PlaneXY(0, 0, 0), SizeX=B, SizeY=B, ExtentX=division, ExtentY=division_2)  # -> Cells, Points
C = ClusterOutput(recgrid.Cells)
P = ClusterOutput(recgrid.Points)
