# Grasshopper definition grid-cluster-pasted_6.gh (Grasshopper 1.0.8)
# The edges of the cells of a regular grid, and how many there are.

# ---- group: gi_site
# Edges of the grid cells.
# Width, depth and spacing in metres.
width = Slider(24, range=1..60)
depth = Slider(18, range=1..60)
spacing = Slider(3, range=1..6)

# ---- group: f_grid
grid_by_spacing = GridBySpacing(A=width, A_2=depth, B=spacing)  # -> C, P
explode = Explode(Curve=grid_by_spacing.C, Recursive=True)  # -> Segments, Vertices
lng = ListLength(List=explode.Segments)

# ---- group: o_result
result = Panel(lng)

# ==== cluster GridBySpacing
A = ClusterInput()
A_2 = ClusterInput()
B = ClusterInput()
division = Division(A=A, B=B)
division_2 = Division(A=A_2, B=B)
recgrid = Rectangular(Plane=PlaneXY(0, 0, 0), SizeX=B, SizeY=B, ExtentX=division, ExtentY=division_2)  # -> Cells, Points
C = ClusterOutput(recgrid.Cells)
P = ClusterOutput(recgrid.Points)
