# Grasshopper definition old-components_2.gh (Grasshopper 1.0.8)
# A plot as a surface, its area, and how much longer than deep it is.

# ---- group: gi_site
# Plot: its area and its elongation.
# Width and depth in metres.
width = Slider(24, range=1..60)
depth = Slider(18, range=1..60)

# ---- group: f_plot
rectangle = Rectangle(Plane=PlaneXY(0, 0, 0), XSize=width, YSize=depth, Radius=0)  # -> Rectangle, Length
boundary = BoundarySurfaces(Edges=rectangle.Rectangle)
area = Area(Geometry=boundary)  # -> Area, Centroid
subtraction = Subtraction(A=width, B=depth)

# ---- group: o_result
result = Panel(area.Area)
