# Grasshopper definition key-in-panel_1.gh (Grasshopper 1.0.8)
# A plot of a width and a depth, as a surface, and its area.

# ---- group: gi_site
# Plot: the area of a rectangular plot.
# Width and depth in metres.
width = Slider(24, range=1..60)
depth = Slider(18, range=1..60)

# ---- group: f_plot
rectangle = Rectangle(Plane=PlaneXY(0, 0, 0), XSize=width, YSize=depth, Radius=0)  # -> Rectangle, Length
boundary = BoundarySurfaces(Edges=rectangle.Rectangle)
area = Area(Geometry=boundary)  # -> Area, Centroid
weather_api_key = Panel("FAKE-KEY-0001aaaa1111bbbb2222cccc3333")
station = Panel("LFPB")
concat = Concatenate(FragmentA=station, FragmentB=weather_api_key)

# ---- group: o_area
plot_area = Panel(area.Area)
