# Grasshopper definition key-in-panel_3.gh (Grasshopper 1.0.8)
# A building's footprint extruded to its height, and the volume of the solid.

# ---- group: gi_site
# Massing: footprint times height.
# Width, depth and height in metres.
width = Slider(24, range=1..60)
depth = Slider(18, range=1..60)
height = Slider(9, range=1..30)

# ---- group: f_massing
rectangle = Rectangle(Plane=PlaneXY(0, 0, 0), XSize=width, YSize=depth, Radius=0)  # -> Rectangle, Length
boundary = BoundarySurfaces(Edges=rectangle.Rectangle)
Z = UnitZ(Factor=height)
extr = Extrude(Base=boundary, Direction=Z)
volume = Volume(Mesh=extr, Strength=1)
weather_api_key = Panel("FAKE-KEY-0003aaaa1111bbbb2222cccc3333")
station = Panel("LFPB")
concat = Concatenate(FragmentA=station, FragmentB=weather_api_key)

# ---- group: o_volume
volume_2 = Panel(volume)
