# Grasshopper definition key-in-pasted-cluster.gh (Grasshopper 1.0.8)
# A plot of a width and a depth, as a surface, and its area; the query for the weather of its station.

# ---- group: gi_site
# Plot: the area of a rectangular plot.
# Width and depth in metres.
width = Slider(24, range=1..60)
depth = Slider(18, range=1..60)
station = Panel("LFPB")

# ---- group: f_plot
rectangle = Rectangle(Plane=PlaneXY(0, 0, 0), XSize=width, YSize=depth, Radius=0)  # -> Rectangle, Length
boundary = BoundarySurfaces(Edges=rectangle.Rectangle)
area = Area(Geometry=boundary)  # -> Area, Centroid
weather_query = WeatherQuery(A=station)

# ---- group: o_area
plot_area = Panel(area.Area)

# ==== cluster WeatherQuery
A = ClusterInput()
weather_api_key = Panel("FAKE-KEY-0000eeee5555ffff6666aaaa")
concat = Concatenate(FragmentA=A, FragmentB=weather_api_key)
R = ClusterOutput(concat)
