# Grasshopper definition plugin-superseded.gh (Grasshopper 1.0.8)
# plug-ins: Kangaroo Components
# Columns on a regular grid, and how many there are, for a form-finding study.

# ---- group: gi_site
# Columns on a grid.
# Width, depth and spacing in metres; the spacing divides both.
width = Slider(24, range=1..60)
depth = Slider(18, range=1..60)
spacing = Slider(3, range=1..6)

# ---- group: f_grid
division = Division(A=width, B=spacing)
division_2 = Division(A=depth, B=spacing)
recgrid = Rectangular(Plane=PlaneXY(0, 0, 0), SizeX=spacing, SizeY=spacing, ExtentX=division, ExtentY=division_2)  # -> Cells, Points
line = LineSDL(Start=recgrid.Points, Direction=Vector(0, 0, 1), Length=spacing)
lng = ListLength(List=line)

# ---- group: o_count
columns = Panel(lng)

# ----
clean = CombineClean()
