# Grasshopper definition python2-script_1.gh (Grasshopper 1.0.8)
# Gross floor area per level and in total, for twelve levels of a width and a depth.

# ---- group: gi_site
# Floor areas of twelve levels.
# Width and depth in metres.
width = Slider(24, range=1..60)
depth = Slider(18, range=1..60)

# ---- group: f_script
script = GhPythonScript(x=width, y=depth)  # -> out, a
#   port x: The width of the site, in metres
#   port y: The depth of the site, in metres
#   port a: The result, one item per line
# ---------- script: Python ----------
# gross floor area per level, and the total
areas = [x * y for _ in xrange(12)]
print 'total', sum(areas)
a = areas
# ---------- end script ----------

# ---- group: o_result
result = Panel(script.a)
