# Grasshopper definition ds_clustering.gh (Grasshopper 1.0.8)
# Copyright: Sebastien Perrault
# plug-ins: Volvox, Pufferfish, Human, Hops, HDTTreeUtils
# Test bench for the data science clustering Hops service: it sends a point dataset (including synthetic circles and moons test sets) to K-means, DBSCAN and HDBSCAN endpoints and shows the clusters as coloured points, with silhouette scores, number of clusters, noise points, suggested epsilon and the adjusted Rand index against the known answer. Controls cover normalisation, epsilon, minimum samples and cluster size, with notes on performance.

dataset = ValueList({"blobs", "aniso", "varied", "moons", "circles", "no_structure", "iris", "wine"}, selected="circles")
clustering_datasets = Hops(
    Dataset=dataset,
    NSamples=300,
    Noise=0.05,
    Seed=0,
    CacheResultsInMemory=False,
    CacheSolveResults=False,
    RemoteDefinitionLocation="http://127.0.0.1:5000/clustering_datasets",
    RemoteSolveVersion=(0, 1, 0),
    ShowInput_Enabled=False,
    ShowInput_Path=False,
    SynchronousSolve=True)  # -> Data, TrueLabels, NumClustersTrue, Points, Info
dataset_info = Panel(clustering_datasets.Info)

points = Data([Point(5314.857657, 9388.033674, 5.5), Point(5314.347582, 9386.631689, 5.5), Point(5313.837508, 9385.229703, 5.5), Point(5316.269207, 9387.520119, 5.5), Point(5315.759133, 9386.118134, 5.5), Point(5315.249058, 9384.716149, 5.5)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])
dataset_2 = Number(Tree({0}: [0.6666666667, 1, 0, 0, 0, 0, 0, 0, 0.05263157895, 0.3, 0, 0], {1}: [0.6666666667, 1, 0, 0, 0, 0, 0, 0, 0, 0.15, 0, 0], {2}: [0.6666666667, 1, 0, 0, 0, 0, 0, 0, 0, 0.05, 0, 0], {3}: [0.6666666667, 1, 0, 0, 0, 0, 0, 0, 0.05263157895, 0.3, 0, 0], {4}: [0.6666666667, 1, 0, 0, 0, 0, 0, 0, 0.02631578947, 0.05, 0, 0], {5}: [0.6666666667, 1, 0, 0, 0, 0, 0, 0, 0, 0, 0, 0]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))

colorbrewer_set3_n_12 = Panel("""#8dd3c7
#ffffb3
#bebada
#fb8072
#80b1d3
#fdb462
#b3de69
#fccde5
#d9d9d9
#bc80bd
#ccebc5
#ffed6f""")

cluster = Cluster(G=Toggle(True), data=dataset_2)
cluster_2 = Cluster_2(pt=points, num=cluster, B=Slider(1, range=0..1))  # -> pts, data
data = Data(cluster)
pt = Point(flatten(points))

list = ValueList({"dev": "http://127.0.0.1:5000/", "prod": "https://py.echoes.paris/"}, selected="dev")

# ----
# CLUSTERING VALIDATION HARNESS  -  pick a dataset, pick a mode, watch ARI.
# 1.0 = perfect agreement with the known answer, 0.0 = chance.
# Epsilon slider at 0 uses the automatic k-distance suggestion.
# Try 'circles': dbscan fragments it into ~11 clusters (the knee under-estimates
# on rings), while hdbscan recovers both rings exactly. Try 'moons' too.
epsilon_0_auto = Slider(0, range=0..2)
minclustersize = Slider(10, range=2..60)
minsamples = Slider(5, range=2..50)
mode = ValueList({"dbscan", "hdbscan", "optics"}, selected="hdbscan")
dbscan = Hops(
    Points=clustering_datasets.Data,
    Epsilon=epsilon_0_auto,
    MinSamples=minsamples,
    Metric="euclidean",
    Algorithm="auto",
    LeafSize=30,
    Jobs=-1,
    Plot=False,
    Normalize=True,
    Mode=mode,
    MinClusterSize=minclustersize,
    Xi=0.05,
    CacheResultsInMemory=False,
    CacheSolveResults=False,
    RemoteDefinitionLocation="http://127.0.0.1:5000/dbscan",
    RemoteSolveVersion=(0, 1, 0),
    ShowInput_Enabled=False,
    ShowInput_Path=False,
    SynchronousSolve=True)  # -> Labels, NumClusters, NoisePoints, CoreMask, Silhouette, ProcessingTime, Visualization, SuggestedEps
suggestedeps = Panel(dbscan.SuggestedEps)
numclusters = Panel(dbscan.NumClusters)
cluster_score = Hops(
    Labels=dbscan.Labels,
    TrueLabels=clustering_datasets.TrueLabels,
    CacheResultsInMemory=False,
    CacheSolveResults=False,
    RemoteDefinitionLocation="http://127.0.0.1:5000/cluster_score",
    RemoteSolveVersion=(0, 1, 0),
    ShowInput_Enabled=False,
    ShowInput_Path=False,
    SynchronousSolve=True)  # -> ARI, AMI, Homogeneity, Completeness, VMeasure, Report
ari = Panel(cluster_score.ARI)
score_report = Panel(cluster_score.Report)

# ---- group: KMeans performance
silhouette_sample_size = Slider(2000, range=0..5000)
point_scores = BooleanToggle(True)

# ---- group: visualize dataset
lng = ListLength(List=data)
number_slider = Slider(50, range=0..100)
item = ListItem(List=flatten(lng), Index=0, Wrap=True)
series = Series(Start=number_slider, Step=number_slider, Count=item)  # -> graft(Series)
X = UnitX(Factor=series)
move = Move(Geometry=pt, Motion=X)  # -> simplify(Geometry), Transform
flip = FlipMatrix(Data=data)
bnd = Bounds(Numbers=flip)
dedomain = DeconstructDomain(Domain=bnd)  # -> Start, End
gradient = Gradient(
    LowerLimit=dedomain.Start,
    UpperLimit=dedomain.End,
    Parameter=flip,
    stops=[0: RGB(0, 61, 89), 0.25: RGB(0, 155, 180), 0.5: RGB(148, 193, 28), 0.75: RGB(243, 154, 0), 1: RGB(183, 26, 73)])
cloud = ConstructCloud(Points=move.Geometry, Colors=gradient)

# ---- group: new DBSCAN controls
minclustersize_2 = Slider(100, range=2..500)
xi_optics = Slider(0.05, range=0.01..0.5)
normalize = BooleanToggle(True)
mode_2 = ValueList({"dbscan", "hdbscan", "optics"}, selected="optics")

# ----
# DBSCAN controls  -  Epsilon = 0 uses the server's automatic k-distance
# suggestion (read it on the SuggestedEps panel). Epsilon is in Z-SCORE
# units while Normalize is on, not model units.
# Measured on this dataset (12662 pts x 12 dims):
#    dbscan  eps 0.5   -> 346 clusters, silhouette -0.17
#    dbscan  eps auto  ->  23 clusters, silhouette -0.14
#    hdbscan mcs 100   ->  19 clusters, silhouette +0.36   <-- current
toggle = BooleanToggle(False)
concat = Concatenate(FragmentA=list, FragmentB="dbscan")
flip_2 = FlipMatrix(Data=data)
hops = Hops(
    _Path=concat,
    _Enabled=toggle,
    Points=flip_2,
    Epsilon=Slider(0, range=0..1),
    MinSamples=Slider(10, range=0..10),
    Metric="euclidean",
    Algorithm="auto",
    LeafSize=30,
    Jobs="1",
    Plot=Toggle(False),
    Normalize=normalize,
    Mode=mode_2,
    MinClusterSize=minclustersize_2,
    Xi=xi_optics,
    CacheResultsInMemory=False,
    CacheSolveResults=False,
    RemoteDefinitionLocation="http://127.0.0.1:5000/dbscan",
    RemoteSolveVersion=(0, 1, 0),
    ShowInput_Enabled=True,
    ShowInput_Path=True,
    SynchronousSolve=False)  # -> Labels, NumClusters, NoisePoints, CoreMask, Silhouette, ProcessingTime, Visualization, SuggestedEps
panel = Panel(hops.Visualization)
equals = Equality(FirstNumber=hops.Labels, SecondNumber="-1")  # -> Equality, Inequality
cull = CullPattern(List=hops.Labels, CullPattern=equals.Inequality)
cull_2 = CullPattern(List=pt, CullPattern=equals.Inequality)
data_2 = Data(cull)
bnd_2 = Bounds(Numbers=data_2)
dedomain_2 = DeconstructDomain(Domain=bnd_2)  # -> Start, End
gradient_2 = Gradient(
    LowerLimit="0",
    UpperLimit=dedomain_2.End,
    Parameter=data_2,
    stops=[0: RGB(255, 0, 255), 0.252: RGB(137, 212, 244), 0.503: RGB(145, 234, 201), 0.749: RGB(255, 128, 0), 1: RGB(255, 0, 71)])
cloud_2 = ConstructCloud(Points=cull_2, Colors=gradient_2)

# ---- group: DBSCAN readouts
suggestedeps_2 = Panel(hops.SuggestedEps)
numclusters_2 = Panel(hops.NumClusters)
noisepoints = Panel(hops.NoisePoints)
silhouette = Panel(hops.Silhouette)
processingtime = Panel(hops.ProcessingTime)

# ----
# KMeans performance  -  per-point silhouette is O(n^2) and is recomputed for
# every k. point_scores OFF skips it; silhouette_sample_size subsamples the
# average (0 = exact). Measured 10x speedup at n=5000 with the score
# unchanged to 4 decimals. Point_scores OFF leaves the S output empty.
list_2 = ValueList({"3", "4", "5", "6", "7", "8", "9", "10", "11", "12", "13", "14", "15"}, selected=["10", "11", "12", "13", "14"])
plot = BooleanToggle(False)
flip_3 = FlipMatrix(Data=data)  # -> simplify(Data)
concat_2 = Concatenate(FragmentA=list, FragmentB="kmeans")
hops_2 = Hops(
    _Path=concat_2,
    _Enabled=Toggle(False),
    Data=flip_3,
    K_values=list_2,
    X_index=Slider(0, range=0..7),
    Y_index=Slider(1, range=0..18),
    Max_iter=300,
    Tol=0.0001,
    Random_seed=0,
    Show=plot,
    Normalize=True,
    Initialization="k-means++",
    N_init=-1,
    Verbose=False,
    Point_scores=point_scores,
    Silhouette_sample_size=silhouette_sample_size,
    CacheResultsInMemory=False,
    CacheSolveResults=False,
    RemoteDefinitionLocation="http://127.0.0.1:5000/kmeans",
    RemoteSolveVersion=(0, 1, 0),
    ShowInput_Enabled=True,
    ShowInput_Path=True,
    SynchronousSolve=False)  # -> Plot_points, Cluster_labels, Point_scores, Global_scores, Inertia_scores, Centroids, Iterations, Visualizations, Statistics
kmeans_stats = Panel(hops_2.Statistics)
graph = QuickGraph(hops_2.Global_scores, SortOrder=0)
sort = SortList(G_scores=hops_2.Global_scores, ValuesK=list_2)  # -> Keys, reverse(ValuesK)
pt_2 = Point(hops_2.Plot_points)
cset = CreateSet(List=hops_2.Cluster_labels)  # -> Set, Map
best_k = Panel(sort.ValuesK)
number_slider_2 = Slider(0, range=0..10)
str2img = DeserializeImageFromString(ImageString=hops_2.Visualizations)

# ---- group: number of clusters
k = Slider(2, range=2..21)
item_2 = ListItem(List=best_k, Index=0, Wrap=False)

# ----
bitmap = BitmapFromFile(BitmapPath=str2img)  # -> Bitmap, Width, Height; disabled
lng_2 = ListLength(List=str2img)  # disabled
series_2 = Series(Start=0, Step=1, Count=lng_2)  # disabled
multiplication = Multiplication(A=bitmap.Height, B=series_2)  # disabled
Y = UnitY(Factor=multiplication)  # disabled
point = Point(Point(674.1278411, -172.2732318, 0))  # disabled
move_2 = Move(Geometry=point, Motion=Y)  # -> Geometry, Transform; disabled
rectangle = Rectangle(Plane=move_2.Geometry, XSize=bitmap.Width, YSize=bitmap.Height, Radius=0)  # -> Rectangle, Length; disabled
import_image = ImportImage(File=str2img, Rectangle=rectangle.Rectangle, XSamples=bitmap.Width, YSamples=bitmap.Height)  # disabled

item_3 = ListItem(List=str2img, Index=Slider(1, range=0..10), Wrap=False)
image_resource = ImageResource(item_3)

# ---- group: open files
dam = DataDam(DataA=str2img, BufferDelay=10000000, BufferMode=0)
openfile = LBOpenFile(file_path=dam)  # -> report; plug-in component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

# ----
int = Integer(item_2)
col = Colour(colorbrewer_set3_n_12)
range = Range(Domain=Domain(0, 1), Steps=expr("x-1", int))
twnthrucols = TweenThroughColors(
    Colors=col,
    Factor=range,
    Normalized=True,
    Equalized=False,
    Weighted=False,
    Loopback=False,
    Degree=3,
    InterpolationType=0,
    Alpha=True)
split = SplitList(List=col, Index=int)  # -> ListA, ListB
lng_3 = ListLength(List=col)
larger = LargerThan(FirstNumber=int, SecondNumber=lng_3)  # -> LargerThan, OrEqualTo
filter = StreamFilter(Gate=larger.OrEqualTo, Stream0=split.ListA, Stream1=twnthrucols)

branch = TreeBranch(Tree=hops_2.Cluster_labels, Path=item_2, MaintainPaths=True)
branch_2 = TreeBranch(Tree=hops_2.Point_scores, Path=item_2, MaintainPaths=True)
assign_paths = AssignPaths(InputData=flatten(pt), PathsToAssign=flatten(branch))
assign_paths_2 = AssignPaths(InputData=flatten(branch_2), PathsToAssign=flatten(branch))
lng_4 = ListLength(List=assign_paths)
cube = Cube(Value=assign_paths_2)
bnd_3 = Bounds(Numbers=cube)
graft = GraftTree(Tree=filter, IncludeEmptyLists=True, IncludeNullItems=True)  # -> simplify(Tree)
remap = RemapNumbers(Value=cube, Source=bnd_3, Target="0.0001 to 0.5")  # -> Mapped, Clipped
repeat = RepeatData(Data=graft, Length=lng_4)
cloud_3 = ConstructCloud(Points=assign_paths, Colors=repeat)

# ---- group: heavy
dots = DotDisplay(Point=assign_paths, Colour=graft, Size=remap.Mapped)  # disabled

# ==== cluster Cluster
data = ClusterInput()
data_2 = Data(data)

flip = FlipMatrix(Data=data_2)
bnd = Bounds(Numbers=flip)
remap = RemapNumbers(Value=flip, Source=bnd, Target=Domain(0, 1))  # -> Mapped, Clipped
flip_2 = FlipMatrix(Data=remap.Mapped)

G = ClusterInput()
filter = StreamFilter(Gate=G, Stream0=data_2, Stream1=flip_2)  # -> simplify(Stream)
data_3 = ClusterOutput(filter)

# ==== cluster Cluster_2
pt = ClusterInput()
num = ClusterInput()
pt_2 = Point(pt)
num_2 = Number(num)
lng = ListLength(List=pt_2)
B = ClusterInput()
flip = FlipMatrix(Data=num_2)
multiplication = Multiplication(A=lng, B=B)
reduce = RandomReduce(List=pt_2, Reduction=multiplication, Seed=1)  # -> simplify(List)
reduce_2 = RandomReduce(List=flip, Reduction=multiplication, Seed=1)
flip_2 = FlipMatrix(Data=reduce_2)  # -> simplify(Data)
pts = ClusterOutput(reduce)
data = ClusterOutput(flip_2)
