# Grasshopper definition ds_silhouette clustering_example.gh (Grasshopper 1.0.7)
# plug-ins: Human, Pufferfish, HDTTreeUtils, treesloth01, BubalusGH2.0, Hops

# https://github.com/Sonderwoods/GrasshopperScribbles
hops = Hops(
    GetString="key_echoes",
    CacheResultsInMemory=False,
    CacheSolveResults=False,
    RemoteDefinitionLocation="C:\Users\SP\OneDrive - ECHOES\secrets.gh",
    RemoteSolveVersion=(0, 1, 0),
    ShowInput_Enabled=False,
    ShowInput_Path=False,
    SynchronousSolve=True)
your_key_keep_it_private = Panel(hops)
series = Series(Start=0, Step=1, Count="200")
points = Data([Point(5314.857657, 9388.033674, 5.5), Point(5314.347582, 9386.631689, 5.5), Point(5313.837508, 9385.229703, 5.5), Point(5316.269207, 9387.520119, 5.5), Point(5315.759133, 9386.118134, 5.5), Point(5315.249058, 9384.716149, 5.5)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])
dataset = Number(Tree({0}: [0.5744867469, 0.9724101321, 0, 0.6666666667, 1, 0.5, 0.5, 0, 0, 0, 0, 0, 0, 0.05263157895, 0.3, 0, 0], {1}: [0.5622636247, 0.954771086, 0, 0.6666666667, 1, 0.5, 0.5, 0, 0, 0, 0, 0, 0, 0, 0.15, 0, 0], {2}: [0.5500405024, 0.9371320399, 0, 0.6666666667, 1, 0.5, 0.5, 0, 0, 0, 0, 0, 0, 0, 0.05, 0, 0], {3}: [0.6083123073, 0.9659488586, 0, 0.6666666667, 1, 0.5, 0.5, 0, 0, 0, 0, 0, 0, 0.05263157895, 0.3, 0, 0], {4}: [0.5960891851, 0.9483098125, 0, 0.6666666667, 1, 0.5, 0.5, 0, 0, 0, 0, 0, 0, 0.02631578947, 0.05, 0, 0], {5}: [0.5838660628, 0.9306707665, 0, 0.6666666667, 1, 0.5, 0.5, 0, 0, 0, 0, 0, 0, 0, 0, 0, 0]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))
hops_2 = Hops(
    Key=your_key_keep_it_private,
    CacheResultsInMemory=True,
    CacheSolveResults=True,
    RemoteDefinitionLocation="C:\Users\SP\ECHOES\compute - D\compute.rhino3d.appserver\src\files\os_key-server.gh",
    RemoteSolveVersion=(0, 1, 0),
    ShowInput_Enabled=False,
    ShowInput_Path=False,
    SynchronousSolve=True)  # -> Valid, Message

# ---- group: reduce
item = ListItem(List=points, Index=series, Wrap=True)
branch = TreeBranch(Tree=dataset, Path=series, MaintainPaths=True)  # -> simplify(Branch)

# ----
colorbrewer_set3_n_12 = Panel("""#8dd3c7
#ffffb3
#bebada
#fb8072
#80b1d3
#fdb462
#b3de69
#fccde5
#d9d9d9
#bc80bd
#ccebc5
#ffed6f""")
panel = Panel("""5
6
7
8""")
hops_3 = Hops(
    Key=your_key_keep_it_private,
    Dataset=branch,
    Normalize=Toggle(True),
    K=panel,
    X_index=Slider(0, range=0..7),
    Y_index=Slider(1, range=0..18),
    CacheResultsInMemory=True,
    CacheSolveResults=True,
    RemoteDefinitionLocation="https://compute.echoes.paris/ds_silhouette-clustering.gh",
    RemoteSolveVersion=(0, 1, 0),
    ShowInput_Enabled=False,
    ShowInput_Path=False,
    SynchronousSolve=False)  # -> Readme, Points, ClusterLabel, PointScores, GlobalScores, Imgs
cluster_label = Number(hops_3.ClusterLabel)
point_scores = Number(hops_3.PointScores)
gobal_scores = Number(hops_3.GlobalScores)
img = Text(hops_3.Imgs)
sort = SortList(G_scores=gobal_scores, ValuesK=panel)  # -> Keys, reverse(ValuesK)
graph = QuickGraph(gobal_scores, SortOrder=0)
data = Data(img)
best_k = Panel(sort.ValuesK)
item_2 = ListItem(List=data, Index=0, Wrap=True)
str2img = DeserializeImageFromString(ImageString=data)

# ---- group: number of clusters
k = Slider(6, range=2..21)
item_3 = ListItem(List=best_k, Index=0, Wrap=True)

# ----
dam = DataDam(DataA=str2img, BufferDelay=10000000, BufferMode=0)

bitmap = BitmapFromFile(BitmapPath=dam)  # -> Bitmap, Width, Height
lng = ListLength(List=dam)
series_2 = Series(Start=0, Step=1, Count=lng)
multiplication = Multiplication(A=bitmap.Height, B=series_2)
Y = UnitY(Factor=multiplication)
point = Point(Point(674.1278411, -172.2732318, 0))
move = Move(Geometry=point, Motion=Y)  # -> Geometry, Transform
rectangle = Rectangle(Plane=move.Geometry, XSize=bitmap.Width, YSize=bitmap.Height, Radius=0)  # -> Rectangle, Length
import_image = ImportImage(File=dam, Rectangle=rectangle.Rectangle, XSamples=bitmap.Width, YSamples=bitmap.Height)

int = Integer(item_3)
col = Colour(colorbrewer_set3_n_12)
range = Range(Domain=Domain(0, 1), Steps=expr("x-1", int))
twnthrucols = TweenThroughColors(
    Colors=col,
    Factor=range,
    Normalized=True,
    Equalized=False,
    Weighted=False,
    Loopback=False,
    Degree=3,
    InterpolationType=0,
    Alpha=True)
split = SplitList(List=col, Index=int)  # -> ListA, ListB
lng_2 = ListLength(List=col)
larger = LargerThan(FirstNumber=int, SecondNumber=lng_2)  # -> LargerThan, OrEqualTo
filter = StreamFilter(Gate=larger.OrEqualTo, Stream0=split.ListA, Stream1=twnthrucols)

item_4 = ListItem(List=dam, Index=Slider(0, range=0..10), Wrap=False)
image_resource = ImageResource(item_4)

# ---- group: open files
dam_2 = DataDam(DataA=str2img, BufferDelay=10000000, BufferMode=0)
openfile = LBOpenFile(file_path=dam_2)  # -> report; plug-in component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

# ----
branch_2 = TreeBranch(Tree=cluster_label, Path=item_3, MaintainPaths=True)
branch_3 = TreeBranch(Tree=point_scores, Path=item_3, MaintainPaths=True)
pt = Point(item)
assign_paths = AssignPaths(InputData=flatten(pt), PathsToAssign=flatten(branch_2))
assign_paths_2 = AssignPaths(InputData=flatten(branch_3), PathsToAssign=flatten(branch_2))
cube = Cube(Value=assign_paths_2)
bnd = Bounds(Numbers=cube)
graft = GraftTree(Tree=filter, IncludeEmptyLists=True, IncludeNullItems=True)  # -> simplify(Tree)
remap = RemapNumbers(Value=cube, Source=bnd, Target="0.0001 to 0.3")  # -> Mapped, Clipped
dots = DotDisplay(Point=assign_paths, Colour=graft, Size=remap.Mapped)
lng_3 = ListLength(List=branch)
item_5 = ListItem(List=flatten(lng_3), Index=0, Wrap=True)
panel_2 = Panel(item_5)
series_3 = Series(Start=panel_2, Step=1, Count=10)
h1 = Slider(141, range=0..200)
h2 = Slider(6, range=0..30)
w = Slider(400, range=0..400)
bars = ValueList({"by cluster": 0, "by indicator": 1, "white": 2}, selected="white")
text = ValueList({"by cluster": 0, "by indicator": 1}, selected="by cluster")
cluster_s_points = Point(assign_paths)
cluster_s_colors = Colour(filter)
# Clusters characteristics
points_values = Number(assign_paths_2)
color_palette = Colour(colorbrewer_set3_n_12)
dataset_2 = Number(branch)
indicators = Text(series_3)
viewer = ParamViewer(dataset_2)
lng_4 = ListLength(List=viewer)
neg = Negative(Value=h2)
lng_5 = ListLength(List=indicators)

int_2 = Integer(lng_5)
col_2 = Colour(color_palette)
range_2 = Range(Domain=Domain(0, 1), Steps=expr("x-1", int_2))
twnthrucols_2 = TweenThroughColors(
    Colors=col_2,
    Factor=range_2,
    Normalized=True,
    Equalized=False,
    Weighted=False,
    Loopback=False,
    Degree=3,
    InterpolationType=0,
    Alpha=True)
split_2 = SplitList(List=col_2, Index=int_2)  # -> ListA, ListB
lng_6 = ListLength(List=col_2)
larger_2 = LargerThan(FirstNumber=int_2, SecondNumber=lng_6)  # -> LargerThan, OrEqualTo
filter_2 = StreamFilter(Gate=larger_2.OrEqualTo, Stream0=split_2.ListA, Stream1=twnthrucols_2)

X = UnitX(Factor=1)
filter_3 = StreamFilter(Gate=text, Stream0=simplify(graft(cluster_s_colors)), Stream1=filter_2)

series_4 = Series(Start=0, Step=1, Count=lng_4)
assign_paths_3 = AssignPaths(InputData=flatten(series_4), PathsToAssign=flatten(branch_2))
sort_2 = SortList(Keys=points_values, ValuesA=cluster_s_points)  # -> reverse(Keys), reverse(ValuesA)
sort_3 = SortList(Keys=points_values, ValuesA=assign_paths_3)  # -> reverse(Keys), reverse(ValuesA)
item_6 = ListItem(List=sort_2.ValuesA, Index=0, Wrap=True)  # -> flatten(Item)
item_7 = ListItem(List=sort_3.ValuesA, Index=0, Wrap=True)  # -> flatten(Item)
neg_2 = Negative(Value=h1)
branch_4 = TreeBranch(Tree=dataset_2, Path=item_7, MaintainPaths=True)
filter_4 = StreamFilter(
    Gate=bars,
    Stream0=simplify(graft(cluster_s_colors)),
    Stream1=filter_2,
    Stream2=ColourSwatch(SwatchColor=RGB(107, 107, 107)))
sph = Sphere(Base=item_6, Radius=1)

renumber = RenumberPaths(Data=branch_4)
viewer_2 = ParamViewer(renumber)
lng_7 = ListLength(List=viewer_2)

lng_8 = ListLength(List=renumber)
series_5 = Series(Start="-50", Step=neg_2, Count=lng_7)
series_6 = Series(Start=0, Step=neg, Count=lng_8)
addition = Addition(A=graft(series_5), B=series_6)  # -> simplify(Result)
neg_3 = Negative(Value=series_6)
neg_4 = Negative(Value=addition)
multiplication_2 = Multiplication(A=neg_3, B=Slider(0.067, range=0..0.1))  # -> simplify(Result)
pt_2 = ConstructPoint(XCoordinate="150", YCoordinate=addition, ZCoordinate=0)
pt_3 = ConstructPoint(XCoordinate=expr("x/10", "150"), YCoordinate=neg_4, ZCoordinate=0)
multiplication_3 = Multiplication(A=renumber, B=w)
addition_2 = Addition(A=multiplication_2, B=Slider(2, range=0..10))
addition_3 = Addition(A=multiplication_3, B="1")
Z = UnitZ(Factor=addition_2)
move_2 = Move(Geometry=simplify(graft(item_6)), Motion=Z)  # -> Geometry, Transform
multiplication_4 = Multiplication(A=renumber, B=Slider(30, range=0..111))  # -> simplify(Result)

line = LineSDL(Start=pt_2, Direction=X, Length=addition_3)
text_tag_camera = TextTagCamera(Location=move_2.Geometry, Text=indicators, Size=multiplication_4, Colour=graft(cluster_s_colors))
# cluster's characteristic points
preview = CustomPreview(Geometry=sph, Material=cluster_s_colors)
# characteristic points values
texttoscreen = RenderTextToScreen(Text=indicators, Location=simplify(pt_3), Size=expr("x/2", h2), Color=filter_3, m_scWithvp=False)
crvtoscreen = RenderCurveToScreen(Curve=line, Location="0,0,0", ScaleFactor=1, Color=filter_4, Thickness="3", Depth=0.95, Fixed=True, m_scWithvp=False)
