# Grasshopper definition ee_PV_example.gh (Grasshopper 1.0.8)
# plug-ins: Hops
# Example client of the photovoltaic yield Hops function (ee_PV): a surface or mesh is cut by a dot-product test against Z to keep sun-facing faces and sent with context geometry to the Hops component. Inputs include peak power, losses, optimal inclination and angle toggles; outputs are production in kWh per m2 and per year, monthly values, optimal normals and a coloured mesh, with a table preview and a vector display of normals.

list = ValueList({"C:\Users\SP\ECHOES\compute - D\appserver\src\files\", "https://compute.echoes.paris/"}, selected="C:\Users\SP\ECHOES\compute - D\appserver\src\files\")
brep = Brep([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])
srf = Surface([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])
evalsrf = EvaluateSurface(Surface=srf, Point=Point(0.5, 0.5, 0))  # -> Point, Normal, UDirection, VDirection, Frame
Z = UnitZ(Factor=1)
dprod = DotProduct(VectorA=evalsrf.Normal, VectorB=Z, Unitize=False)
equals = Equality(FirstNumber=dprod, SecondNumber="1")  # -> Equality, Inequality
cull = CullPattern(List=srf, CullPattern=equals.Equality)
mjoin = MeshJoin(Meshes=flatten(brep))
mjoin_2 = MeshJoin(Meshes=flatten(cull))
concat = Concatenate(FragmentA=list, FragmentB="ee_PV.gh")
hops = Hops(
    _Path=concat,
    _Enabled=Toggle(True),
    PeakpowerKW=1,
    Loss=14,
    OptimalInclination=Toggle(True),
    OptimalAngles=Toggle(True),
    UseHorizon=Toggle(True),
    Width=2.066,
    Height=0.998,
    Context=mjoin,
    Geometry=mjoin_2,
    EpwUrl="https://energyplus-weather.s3.amazonaws.com/europe_wmo_region_6/FRA/FRA_Paris.Orly.071490_IWEC/FRA_Paris.Orly.071490_IWEC.zip",
    CacheResultsInMemory=False,
    CacheSolveResults=False,
    RemoteDefinitionLocation="C:\Users\SP\ECHOES\compute - D\appserver\src\files\ee_PV.gh",
    RemoteSolveVersion=(0, 1, 0),
    ShowInput_Enabled=True,
    ShowInput_Path=True,
    SynchronousSolve=False)  # -> Read_me, E_d, Mesh_kWh_m²_y, E_m, Production_kWh_m²_y, Production_kWh_y, HI_d, OptNormals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
panel = Panel(hops.E_m)
panel_2 = Panel(hops.Production_kWh_y)
mesh = Mesh(hops.Mesh_kWh_m²)
facen = FaceNormals(Mesh=hops.Mesh_kWh_m²_y)  # -> Centers, Normals
panel_3 = Panel(hops.Production_kWh_m²_y)
vdis = VectorDisplay(Anchor=facen.Centers, Vector=expr("-x*3", hops.OptNormals))
graph = QuickGraph(hops.E_d, SortOrder=0)
