# Grasshopper definition ee_massing-analytics.gh (Grasshopper 1.0.7)
# plug-ins: EleFront, LadybugGrasshopper, Hops, Human

panel = Panel("http://compute.echoes.paris/")
your_key_keep_it_private = Panel("default")

reflay = ReferenceByLayer(LayerName="facades")
mjoin = MeshJoin(Meshes=reflay)
c_script = CSharpScript(mesh=mjoin)  # -> base64Draco; inputs mesh: Mesh
# ---------- c_script: C# ----------
    var options = new Rhino.FileIO.DracoCompressionOptions();
    options.CompressionLevel = 5;
    options.IncludeTextureCoordinates = false;
    options.IncludeVertexColors = false;

    var compressed = Rhino.FileIO.DracoCompression.Compress(mesh, options);
    base64Draco = compressed.ToBase64String();
# ---------- end c_script ----------
item = ListItem(List=reflay, Index=Slider(7, range=0..8), Wrap=True)

panel_2 = Panel("https://energyplus-weather.s3.amazonaws.com/europe_wmo_region_6/FRA/FRA_Brest.071100_IWEC/FRA_Brest.071100_IWEC.zip")
panel_3 = Panel("""Catégorie 1
Catégorie 2
Catégorie 3
Catégorie 4
Catégorie 5""")
panel_4 = Panel("""#0000F0
#D903D3
#F80B05
#EE8007
#B89300""")
falsestart = LBFalseStartToggle(False)
falsestart_2 = LBFalseStartToggle(False)
falsestart_3 = LBFalseStartToggle(False)
falsestart_4 = LBFalseStartToggle(False)
falsestart_5 = LBFalseStartToggle(True)
falsestart_6 = LBFalseStartToggle(False)
falsestart_7 = LBFalseStartToggle(False)
falsestart_8 = LBFalseStartToggle(False)
falsestart_9 = LBFalseStartToggle(False)
reflay_2 = ReferenceByLayer(LayerName=panel_3)  # -> simplify(Geometry)
summersunvec = Text([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])
wintersunvec = Text(["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", "{-0.770466,0.636526,-0.034891};{-0.615339,0.773538,-0.151645};{-0.418378,0.875786,-0.240746};{-0.192929,0.936254,-0.293609};{0.045659,0.950822,-0.306354};{0.281137,0.918497,-0.278075};{0.497453,0.841489,-0.210799};{0.67992,0.725039,-0.109666}", "{-0.842105,0.52916,-0.104159};{-0.693152,0.680946,-0.236331};{-0.496962,0.798601,-0.339508};{-0.266884,0.874085,-0.405892};{-0.018592,0.902239,-0.430834};{0.230997,0.881131,-0.412611};{0.46488,0.81216,-0.352538};{0.667112,0.700055,-0.254726};{0.823917,0.552423,-0.126448}"])
previewlw = CustomPreviewLineweights(Geometry=reflay_2, Shader=graft(panel_4), Thickness="2", Absolute=False)
hoys_hdd = Text("480;481;482;483;484;485;486;487;488;489;490;491;492;493;494;495;496;497;498;499;500;501;502;503")
pois = Point([<point referenced from the Rhino model> x3])
resolution_m = Slider(5, range=1..10)
list = ValueList({"Horiz Radial": 0, "Horiz 30°": 1, "Spherical": 2, "Sky Exposure": 3, "Sky View": 4}, selected=["Horiz Radial", "Sky Exposure", "Sky View"])
list_2 = ValueList({"Horiz Radial": 0, "Horiz 30°": 1, "Spherical": 2, "Sky Exposure": 3, "Sky View": 4}, selected="Sky Exposure")
list_3 = ValueList({"Horiz Radial": 0, "Horiz 30°": 1, "Spherical": 2, "Sky Exposure": 3, "Sky View": 4}, selected="Sky View")
concat = Concatenate(FragmentA=panel, FragmentB="ee_SUN.gh")
concat_2 = Concatenate(FragmentA=panel, FragmentB="ee_MSV.gh")
concat_3 = Concatenate(FragmentA=panel, FragmentB="ee_SKY.gh")
concat_4 = Concatenate(FragmentA=panel, FragmentB="ee_VIEW.gh")
concat_5 = Concatenate(FragmentA=panel, FragmentB="ee_RAD.gh")
concat_6 = Concatenate(FragmentA=panel, FragmentB="ee_NRB.gh")
concat_7 = Concatenate(FragmentA=panel, FragmentB="ee_CBB.gh")
hops = Hops(
    _Path=concat_5,
    _Enabled=falsestart_5,
    Key=your_key_keep_it_private,
    Geometry=item,
    Context_d=c_script,
    HOY=hoys_hdd,
    WeatherURL=panel_2,
    CacheResultsInMemory=True,
    CacheSolveResults=True,
    RemoteDefinitionLocation="http://compute.echoes.paris/ee_RAD.gh",
    RemoteSolveVersion=(0, 1, 0),
    ShowInput_Enabled=True,
    ShowInput_Path=True,
    SynchronousSolve=False)  # -> Readme, Mesh, LegMesh, LegPar, MeshResults, Metrics, Values
hops_2 = Hops(
    _Path=concat_6,
    _Enabled=falsestart_6,
    Key=your_key_keep_it_private,
    Geometry=item,
    Context_d=c_script,
    WeatherURL=panel_2,
    HarmfulT=18,
    HelpfulT=15,
    CacheResultsInMemory=True,
    CacheSolveResults=True,
    RemoteDefinitionLocation="http://compute.echoes.paris/ee_NRB.gh",
    RemoteSolveVersion=(0, 1, 0),
    ShowInput_Enabled=True,
    ShowInput_Path=True,
    SynchronousSolve=False)  # -> Readme, Mesh, LegMesh, LegPar, MeshResults, Metrics, Values
hops_3 = Hops(
    _Path=concat,
    _Enabled=falsestart,
    Key=your_key_keep_it_private,
    Timestep=1,
    Geometry=item,
    Context_d=c_script,
    SunVec=summersunvec,
    CacheResultsInMemory=True,
    CacheSolveResults=True,
    RemoteDefinitionLocation="http://compute.echoes.paris/ee_SUN.gh",
    RemoteSolveVersion=(0, 1, 0),
    ShowInput_Enabled=True,
    ShowInput_Path=True,
    SynchronousSolve=False)  # -> Readme, Mesh, LegMesh, LegPar, MeshResults, Metrics, Values
hops_4 = Hops(
    _Path=concat_2,
    _Enabled=falsestart_8,
    Key=your_key_keep_it_private,
    Geometry=item,
    Context_d=c_script,
    SunVec=summersunvec,
    Treshhold="70",
    CacheResultsInMemory=True,
    CacheSolveResults=True,
    RemoteDefinitionLocation="http://compute.echoes.paris/ee_MSV.gh",
    RemoteSolveVersion=(0, 1, 0),
    ShowInput_Enabled=True,
    ShowInput_Path=True,
    SynchronousSolve=False)  # -> Readme, R_S, R_aD, R_D, R_ah, R_ac, Analysis, Mesh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
hops_5 = Hops(
    _Path=concat_3,
    _Enabled=falsestart_9,
    Key=your_key_keep_it_private,
    ViewType=list,
    Geometry=item,
    Context_d=c_script,
    CacheResultsInMemory=True,
    CacheSolveResults=True,
    RemoteDefinitionLocation="http://compute.echoes.paris/ee_SKY.gh",
    RemoteSolveVersion=(0, 1, 0),
    ShowInput_Enabled=True,
    ShowInput_Path=True,
    SynchronousSolve=False)  # -> Readme, Analysis, Mesh, LegMesh, LegPar, MeshResults, Metrics, Values
hops_6 = Hops(
    _Path=concat_3,
    _Enabled=falsestart_2,
    Key=your_key_keep_it_private,
    ViewType=list_2,
    Geometry=item,
    Context_d=c_script,
    CacheResultsInMemory=True,
    CacheSolveResults=True,
    RemoteDefinitionLocation="http://compute.echoes.paris/ee_SKY.gh",
    RemoteSolveVersion=(0, 1, 0),
    ShowInput_Enabled=True,
    ShowInput_Path=True,
    SynchronousSolve=False)  # -> Readme, Analysis, Mesh, LegMesh, LegPar, MeshResults, Metrics, Values
hops_7 = Hops(
    _Path=concat_3,
    _Enabled=falsestart_3,
    Key=your_key_keep_it_private,
    ViewType=list_3,
    Geometry=item,
    Context_d=c_script,
    CacheResultsInMemory=True,
    CacheSolveResults=True,
    RemoteDefinitionLocation="http://compute.echoes.paris/ee_SKY.gh",
    RemoteSolveVersion=(0, 1, 0),
    ShowInput_Enabled=True,
    ShowInput_Path=True,
    SynchronousSolve=False)  # -> Readme, Analysis, Mesh, LegMesh, LegPar, MeshResults, Metrics, Values
hops_8 = Hops(
    _Path=concat_4,
    _Enabled=falsestart_4,
    Key=your_key_keep_it_private,
    POIs=pois,
    Geometry=item,
    Context_d=c_script,
    CacheResultsInMemory=True,
    CacheSolveResults=True,
    RemoteDefinitionLocation="http://compute.echoes.paris/ee_VIEW.gh",
    RemoteSolveVersion=(0, 1, 0),
    ShowInput_Enabled=True,
    ShowInput_Path=True,
    SynchronousSolve=False)  # -> Readme, Mesh, LegMesh, LegPar, MeshResults, Metrics, Values
hops_9 = Hops(
    _Path=concat_7,
    _Enabled=falsestart_7,
    Key=your_key_keep_it_private,
    Geometry=item,
    Context_d=c_script,
    Infras=reflay_2,
    ResM=10,
    CacheResultsInMemory=True,
    CacheSolveResults=True,
    RemoteDefinitionLocation="http://compute.echoes.paris/ee_CBB.gh",
    RemoteSolveVersion=(0, 1, 0),
    ShowInput_Enabled=True,
    ShowInput_Path=True,
    SynchronousSolve=False)  # -> Readme, Mesh, LegMesh, LegPar, MeshResults, Metrics, Values
panel_5 = Panel(hops_3.Readme)
panel_6 = Panel(hops_5.Readme)
panel_7 = Panel(hops_6.Readme)
panel_8 = Panel(hops_6.Analysis)
panel_9 = Panel(hops_7.Readme)
panel_10 = Panel(hops_7.Analysis)
panel_11 = Panel(hops_8.Readme)
panel_12 = Panel(hops.Readme)
panel_13 = Panel(hops_4.Readme)
panel_14 = Panel(hops_5.Analysis)
panel_15 = Panel(hops_2.Readme)
panel_16 = Panel(hops_2.Metrics)
panel_17 = Panel(hops_2.Values)
panel_18 = Panel(hops_9.Readme)
panel_19 = Panel(hops_9.Metrics)
panel_20 = Panel(hops_9.Values)
mesh = Mesh(hops_3.Mesh)
item_2 = ListItem(List=hops_4.Mesh, Index=Slider(0, range=0..3), Wrap=True)
mesh_2 = Mesh(hops_5.Mesh)
mesh_3 = Mesh(hops_6.Mesh)
mesh_4 = Mesh(hops_7.Mesh)
mesh_5 = Mesh(hops_8.Mesh)
mesh_6 = Mesh(hops.Mesh)
mesh_7 = Mesh(hops_2.Mesh)
mesh_8 = Mesh(hops_9.Mesh)
line = LineSDL(Start=hops_4.R_S, Direction=hops_4.R_aD, Length=hops_4.R_ah)
line_2 = LineSDL(Start=hops_4.R_S, Direction=hops_4.R_D, Length=1)
falsestart_10 = LBFalseStartToggle(True)
previewlw_2 = CustomPreviewLineweights(Geometry=line, Shader=ColourSwatch(SwatchColor=RGB(255, 0, 1)), Absolute=False)
previewlw_3 = CustomPreviewLineweights(Geometry=line_2, Shader=ColourSwatch(SwatchColor=RGB(255, 255, 1)), Absolute=False)
concat_8 = Concatenate(FragmentA=panel, FragmentB="ee_PAR.gh")
split = TextSplit(Text=hops.MeshResults, Separators=",")
hops_10 = Hops(
    _Path=concat_8,
    _Enabled=falsestart_10,
    Geometry=mesh_6,
    RADKWhM²=split,
    CacheResultsInMemory=True,
    CacheSolveResults=False,
    RemoteDefinitionLocation="http://compute.echoes.paris/ee_PAR.gh",
    RemoteSolveVersion=(0, 1, 0),
    ShowInput_Enabled=True,
    ShowInput_Path=True,
    SynchronousSolve=False)  # -> Mesh, LegMesh, LegPar, PPFD_µmole_m²_s, PAR_µmole_m²_s, Metrics, port, Mesh_
mesh_9 = Mesh(hops_10.Mesh_)
