# Grasshopper definition ee_surface temperature_example.gh (Grasshopper 1.0.7)
# plug-ins: Wombat, Heteroptera, karambaGH, Human, LadybugGrasshopper, Weaverbird, Hops, froGH, PancakeSpreadsheet

hops = Hops(
    GetString="key_echoes",
    CacheResultsInMemory=True,
    CacheSolveResults=True,
    RemoteDefinitionLocation="C:\Users\SP\OneDrive - ECHOES\secrets.gh",
    RemoteSolveVersion=(0, 1, 0),
    ShowInput_Enabled=False,
    ShowInput_Path=False,
    SynchronousSolve=True)

# ----
# http://compute.echoes.paris/
your_key_keep_it_private = Panel(hops)

hops_2 = Hops(
    Key=hops,
    CacheResultsInMemory=True,
    CacheSolveResults=True,
    RemoteDefinitionLocation="https://compute.echoes.paris/os_key-server.gh",
    RemoteSolveVersion=(0, 1, 0),
    ShowInput_Enabled=False,
    ShowInput_Path=False,
    SynchronousSolve=True)  # -> Valid, Message
f_ghfilepath = GHFilePathInfo()  # -> FileName, FilePath
panel = Panel(hops_2.Valid)
unit_warning = UnitWarning(UnitSystem=4)
concat = Concatenate(FragmentA=f_ghfilepath.FilePath, FragmentB="ee_surface temperature_example.3dm")
_3dm = Read3dmFile(FilePath=concat, LayerFilter="*")  # -> Objects, LayerNames, Attributes, Units
concat_2 = Concatenate(FragmentA=f_ghfilepath.FilePath, FragmentB="ICETool-GH\Material_database.xlsx")
panel_2 = Panel("""buildings
trees
materials::""")
black = ColourSwatch(SwatchColor=RGB(0, 0, 0))
tmatch = MatchText(Text=_3dm.LayerNames, RegEx=graft(panel_2), Case=True)

psopenspreadsheet = OpenSpreadsheet(File=concat_2, OpenMode=0, OK=Toggle(True))
pssheetlist = SheetList(Spreadsheet=psopenspreadsheet)  # -> Sheets, SheetVisbilities, ActiveSheetIndex
item = ListItem(List=pssheetlist.Sheets, Index=0, Wrap=True)
psgetsheet = GetSheet(Spreadsheet=psopenspreadsheet, Identifier=item)
pssheetentirerange = SheetEntireRange(Sheet=psgetsheet)
psgetmulticells = GetMultipleCells(Sheet=psgetsheet, CellRange=pssheetentirerange, Type=3, RowFirst=Toggle(True))

cull = CullPattern(List=_3dm.Objects, CullPattern=tmatch)  # -> simplify(List)
cull_2 = CullPattern(List=_3dm.LayerNames, CullPattern=tmatch)  # -> simplify(List)
bang = ExplodeTree(Data=cull)  # -> Branch0, Branch1, Branch2
bang_2 = ExplodeTree(Data=cull_2)  # -> Branch0, Branch1, Branch2
split = TextSplit(Text=bang_2.Branch2, Separators=":")
item_2 = ListItem(List=reverse(split), Index=0, Wrap=True)  # -> flatten(Item)
Z = UnitZ(Factor="6")
path = ConstructPath(Indices="0")
division = Division(A="6", B=1.5)
move = Move(Geometry=bang.Branch1, Motion=Z)  # -> Geometry, Transform
geo = Geometry(bang.Branch2)
txt = Text(item_2)
split_2 = SplitTree(Data=psgetmulticells, Masks=flatten(path))  # -> Positive, Negative
panel_3 = Panel(txt)
msphere = MeshSphere(Base=move.Geometry, Radius=division, UCount="6", VCount="6")
viewer = ParamViewer(geo)
list = ValueList({".5", "1", "2", "3", "5", "10"}, selected="2")

# ---- group: load DB
panel_4 = Panel("""alb
em
Cv
lambd
ep
kc""")
mindex = MemberIndex(Set=split_2.Positive, Member="ID")  # -> Index, Count
mindex_2 = MemberIndex(Set=split_2.Positive, Member="name")  # -> Index, Count
mindex_3 = MemberIndex(Set=split_2.Positive, Member=panel_4)  # -> flatten(Index), Count

# ----
entwine = Entwine(Branch00=mindex.Index, Branch01=mindex_2.Index, Branch02=mindex_3.Index, FlattenInputs=True)  # -> flatten(Result)

# ----
# pb orientation
mesh_breps = MeshBrepsKaramba3D(
    Brep=geo,
    MeshResolution=Slider(3, range=0..10),
    EdgeRefinementFactor=0.67,
    PointReduction=False,
    SmoothingStepSize=0,
    SmoothingIterations=5)  # -> Mesh, Info; disabled

dpath = DeconstructPath(Branch=viewer)  # -> simplify(Indices)
custom_mesh_settings = SettingsCustom(
    StitchSeams=True,
    SimplePlanes=False,
    Refine="0",
    MinCount=16,
    MaxCount=100,
    AspectRatio=20,
    MaxDistance=0,
    MaxAngle=20,
    MinEdge=expr("x/1.1", list),
    MaxEdge=expr("x*1.1", list))
lng = ListLength(List=geo)
item_3 = ListItem(List=psgetmulticells, Index=flatten(entwine), Wrap=True)
repeat = RepeatData(Data=dpath, Length=lng)

wires = BrepWireframe(Brep=[geo, bang.Branch0], Density=-1)
wbedges = WeaverbirdsMeshEdges(MeshOrPolylines=msphere)
previewlw = CustomPreviewLineweights(Geometry=[wires, wbedges], Shader=black, Absolute=False)

clean = CleanTree(RemoveNulls=True, RemoveInvalid=True, RemoveEmpty=True, Tree=geo)  # -> flatten(Tree)
clean_2 = CleanTree(RemoveNulls=True, RemoveInvalid=True, RemoveEmpty=True, Tree=repeat)  # -> simplify(Tree)
join = TextJoin(Text=item_3, Join=",")  # -> flatten(Result)
mesh = MeshBrep(Brep=bang.Branch0, Settings=custom_mesh_settings)
mesh_2 = MeshBrep(Brep=clean, Settings=custom_mesh_settings)
item_4 = ListItem(List=panel_3, Index=clean_2, Wrap=True)  # -> flatten(Item)
mjoin = MeshJoin(Meshes=flatten([mesh, msphere]))

mjoin_2 = MeshJoin(Meshes=mesh)

entwine_2 = Entwine(Branch00="CC1", Branch01=item_4, FlattenInputs=True)  # -> flatten(Result)
entwine_3 = Entwine(Branch00=mjoin_2, Branch01=mesh_2, FlattenInputs=True)  # -> flatten(Result)
panel_5 = Panel("https://energyplus-weather.s3.amazonaws.com/europe_wmo_region_6/FRA/FRA_Paris.Orly.071490_IWEC/FRA_Paris.Orly.071490_IWEC.zip")
falsestart = LBFalseStartToggle(False)
hops_3 = Hops(
    _Enabled=falsestart,
    Key=your_key_keep_it_private,
    MaterialData=join,
    Geometry=entwine_3,
    Materials=entwine_2,
    Context=mjoin,
    Month="7",
    Day="21",
    EpwURL=panel_5,
    CacheResultsInMemory=True,
    CacheSolveResults=True,
    RemoteDefinitionLocation="https://compute.echoes.paris/ee_Surface-Temperature.gh",
    RemoteSolveVersion=(0, 1, 0),
    ShowInput_Enabled=True,
    ShowInput_Path=False,
    SynchronousSolve=False)  # -> Readme, Mesh, TC
range = Range(Domain=Domain(0, 1), Steps="9")
data = Data(hops_3.TC)
gradient = Gradient(
    LowerLimit=0,
    UpperLimit=1,
    Parameter=range,
    stops=[0: RGB(28, 77, 107), 0.249: RGB(56, 164, 166), 0.495: RGB(245, 210, 95), 0.75: RGB(237, 148, 76), 1: RGB(235, 86, 56)])
colrange = LBColorRange(index=Slider(0, range=0..25))  # -> colors; plug-in component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
h = Slider(12, range=0..23)
col = Colour(gradient)
bnd = Bounds(Numbers=flatten(data))
extremums = MinMax(Number=data)  # -> flatten(Minimum), flatten(Maximum)
avr = Average(Input=data)  # -> flatten(ArithmeticMean)
item_5 = ListItem(List=data, Index=h, Wrap=False)  # -> flatten(Item)
xy = XYPlane(Origin=Point(0, 0, 0))
dedomain = DeconstructDomain(Domain=bnd)  # -> Start, End
legendpar = LBLegendParameters(
    min=dedomain.Start,
    max=dedomain.End,
    seg_count="11",
    colors=colrange,
    continuous_leg="0",
    num_decimals="0",
    larger_smaller="0",
    vert_or_horiz="0")  # -> leg_par; plug-in component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
panel_6 = Panel(bnd)
panel_7 = Panel("max")
panel_8 = Panel("mean")
panel_9 = Panel("min")
concat_3 = Concatenate(FragmentA=h, FragmentB="h")
bnd_2 = Bounds(Numbers=flatten(item_5))
panel_10 = Panel(bnd_2)
heatmap = LBSpatialHeatmap(values=item_5, mesh=hops_3.Mesh, legend_par=legendpar, legend_title=concat_3)  # -> mesh, legend, title, colors, legend_par; plug-in component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
mesh_3 = Mesh(heatmap.mesh)
