# Grasshopper definition ee_surface temperature_example_material database.gh (Grasshopper 1.0.7)
# plug-ins: HDTTreeUtils, Hops, LadybugGrasshopper, MetaHopper, Pancake, treesloth01

panel = Panel("ICE_database_SP.csv")  # disabled
relpath = RelativePath(Path=panel)  # disabled
file = ReadFile(File=relpath, PerLineParse=True)  # disabled
data = Data(["ID,name,french_name,color,rugosity_age,alb,em,Cv,lambd,ep,kc,source,version,comments", "MHBTON,Mesh Concrete,Mesh Beton,Grey,New/Rough,0.30,0.90,2083000.0,1.63,0.3,0.0,MM,1.0,", "SD1,Quartzite,Quartzite,Beige/brown/black,New/Rough,0.26,0.92,1794000.0,5.0,0.2,0.0,LUMA_2013,1.0,", "SD2,Quartzite,Quartzite,Beige/brown/black,New/Rough,0.32,0.96,1794000.0,5.0,0.2,0.0,LUMA_2013,1.0,", "SD3,Quartzite,Quartzite,Brown,New/Rough,0.25,0.97,1794000.0,5.0,0.2,0.0,LUMA_2013,1.0,", "ST1,Sandstone,Gres,Beige,Used,0.4,0.9,1490000.0,3.0,0.2,0.0,LUMA_2013,1.0,"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])

# ---- group: load DB
pccsvtoassoc = CSVToAssoc(CSV=data, Delimiter=",", ParseAsQuantity=True, RecognizeType=True, LastSaveLocalization="neutral")
pcassoctodatatable = AssocToDatatable(Assoc=pccsvtoassoc, FlipOutput=False, LastSaveLocalization="neutral")  # -> simplify(Headers), simplify(Values)
panel_2 = Panel("""alb
em
Cv
lambd
ep
kc""")
mindex = MemberIndex(Set=pcassoctodatatable.Headers, Member="ID")  # -> Index, Count
mindex_2 = MemberIndex(Set=pcassoctodatatable.Headers, Member="name")  # -> Index, Count
mindex_3 = MemberIndex(Set=pcassoctodatatable.Headers, Member=panel_2)  # -> Index, Count
branch = TreeBranch(Tree=pcassoctodatatable.Values, Path=mindex.Index, MaintainPaths=True)  # -> flatten(Branch)
branch_2 = TreeBranch(Tree=pcassoctodatatable.Values, Path=mindex_2.Index, MaintainPaths=True)  # -> flatten(Branch)
branch_3 = TreeBranch(Tree=pcassoctodatatable.Values, Path=mindex_3.Index, MaintainPaths=True)  # -> simplify(Branch)
renumber = RenumberPaths(Data=branch_3)

# ----
_121212 = ColourSwatch(SwatchColor=RGB(18, 18, 18))
_80b1d3 = ColourSwatch(SwatchColor=RGB(128, 177, 211))
_8dd3c7 = ColourSwatch(SwatchColor=RGB(141, 211, 199))
fb8072 = ColourSwatch(SwatchColor=RGB(251, 128, 114))
bebada = ColourSwatch(SwatchColor=RGB(190, 186, 218))
fdb462 = ColourSwatch(SwatchColor=RGB(253, 180, 98))
f0f0f0 = ColourSwatch(SwatchColor=RGB(240, 240, 240))

falsestart = LBFalseStartToggle(True)
list = ValueList({"localhost": "http://127.0.0.1:5000/", "echoespy": "https://echoespy.herokuapp.com/", "EC2Py": "http://15.236.200.153:5090/"}, selected="echoespy")

precipitations = Number(Tree({4824}: [0.623], {4825}: [0.623], {4826}: [0.623], {4827}: [0.623], {4828}: [0.623], {4829}: [0.623]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))
mesh_points = Data([Point(0.5, 2.5, 0), Point(1.5, 2.5, 0), Point(2.5, 2.5, 0), Point(3.5, 2.5, 0), Point(4.5, 2.5, 0), Point(5.5, 2.5, 0)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])
temp_c = Number(Tree({4824}: [20], {4825}: [19.1], {4826}: [19], {4827}: [18], {4828}: [16], {4829}: [15]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))
shadows = Integer(Tree({4824}: [0, 0, 0, 0, 0, 0, 0, 0, 0, 0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], {4825}: [0, 0, 0, 0, 0, 0, 0, 0, 0, 0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], {4826}: [0, 0, 0, 0, 0, 0, 0, 0, 0, 0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], {4827}: [0, 0, 0, 0, 0, 0, 0, 0, 0, 0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], {4828}: [0, 0, 0, 0, 0, 0, 0, 0, 0, 0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], {4829}: [0, 0, 0, 0, 0, 0, 0, 0, 0, 0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]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))
tag = Text(branch)
hc = Number(Tree({4824}: [5, 5, 5, 5, 5, 5, 5, 5, 5, 5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], {4825}: [5, 5, 5, 5, 5, 5, 5, 5, 5, 5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], {4826}: [5, 5, 5, 5, 5, 5, 5, 5, 5, 5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], {4827}: [5, 5, 5, 5, 5, 5, 5, 5, 5, 5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], {4828}: [5, 5, 5, 5, 5, 5, 5, 5, 5, 5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], {4829}: [5, 5, 5, 5, 5, 5, 5, 5, 5, 5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]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))
tint_c = Number(16)
matdb = Text(data)
rad = Number(Tree({4824}: [0], {4825}: [0], {4826}: [0], {4827}: [0], {4828}: [0], {4829}: [9]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))

concat = Concatenate(FragmentA=list, FragmentB="temp_calc_rad")
hops = Hops(
    _Path=concat,
    _Enabled=falsestart,
    Mesh_Points=mesh_points,
    Material_tag=tag,
    Db_temp=temp_c,
    Hc_data=hc,
    Precipitation=precipitations,
    Tint=tint_c,
    Materials_info=matdb,
    Global_radiation=rad,
    Shadows=shadows,
    CacheResultsInMemory=False,
    CacheSolveResults=False,
    RemoteDefinitionLocation="https://echoespy.herokuapp.com/temp_calc_rad",
    RemoteSolveVersion=(0, 1, 0),
    ShowInput_Enabled=True,
    ShowInput_Path=True,
    SynchronousSolve=True)  # -> Surf_temp_K, Surf_temp_C, Mesh_Path, HOY_Path
range = Range(Domain=Domain(0, 1), Steps="9")
gradient = Gradient(
    LowerLimit=0,
    UpperLimit=1,
    Parameter=range,
    stops=[0: RGB(28, 77, 107), 0.249: RGB(56, 164, 166), 0.495: RGB(245, 210, 95), 0.75: RGB(237, 148, 76), 1: RGB(235, 86, 56)])
assign_paths = AssignPaths(InputData=flatten(hops.Surf_temp_C), PathsToAssign=flatten(hops.Mesh_Path))
bnd = Bounds(Numbers=flatten(assign_paths))
colrange = LBColorRange(index=Slider(0, range=0..25))  # -> colors; plug-in component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
dedomain = DeconstructDomain(Domain=bnd)  # -> Start, End
xy = XYPlane(Origin=Point(0, 0, 0))
lng = ListLength(List=matdb)  # -> expr("x-1", Length)
legendpar = LBLegendParameters(
    min=dedomain.Start,
    max=dedomain.End,
    seg_count="11",
    colors=gradient,
    continuous_leg="0",
    num_decimals="0",
    larger_smaller="0",
    vert_or_horiz="0",
    base_plane=xy)  # -> leg_par; plug-in component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
panel_3 = Panel(bnd)
rectangle = Rectangle(Plane=PlaneXY(0, 0, 0), XSize=lng, YSize="0 to 5", Radius=0)  # -> Rectangle, Length
col = Colour(f0f0f0)

# ---- group: Dataviz
data_2 = Data(branch)
addition = Addition(A="5", B=".2")
addition_2 = Addition(A=".6", B=".2")
lng_2 = ListLength(List=panel_2)
lng_3 = ListLength(List=data_2)  # -> flatten(Length)
series = Series(Start=addition, Step=addition_2, Count=lng_2)
pt = ConstructPoint(XCoordinate=0, YCoordinate=series, ZCoordinate=0)
repeat = RepeatData(Data=_121212, Length=lng_2)  # -> simplify(graft(Data))
col_2 = Colour(simplify(graft([_8dd3c7, f0f0f0, bebada, fb8072, _80b1d3, fdb462])))
series_2 = Series(Start=".5", Step=1, Count=lng_3)
rectangle_2 = Rectangle(Plane=pt, XSize=lng_3, YSize=".6", Radius=0)  # -> Rectangle, Length
mplane = MeshPlane(Boundary=rectangle_2.Rectangle, WidthCount=lng_3, HeightCount="1")  # -> simplify(graft(Mesh)), Area
addition_3 = Addition(A=series_2, B=".35")
division = Division(A=".6", B="2")
legendpar_2 = LBLegendParameters(seg_count="2", colors=[repeat, col_2], seg_height=division, seg_width=".5")  # -> leg_par; plug-in component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
pt_2 = ConstructPoint(XCoordinate=series_2, YCoordinate="-.5", ZCoordinate=0)
pt_3 = ConstructPoint(XCoordinate=addition_3, YCoordinate="-.5", ZCoordinate=0)
prot = RotatePlane(Plane=pt_2, Angle="Pi/2")
prot_2 = RotatePlane(Plane=pt_3, Angle="Pi/2")
heatmap = LBSpatialHeatmap(values=renumber, mesh=mplane.Mesh, legend_par=legendpar_2, legend_title=graft(panel_2))  # -> mesh, legend, title, colors, legend_par; plug-in component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
tag_2 = TextTag3D(Location=prot, Text=data_2, Size=".4", Colour=col, Justification=6)
tag_3 = TextTag3D(Location=prot_2, Text=branch_2, Size=".2", Colour=col, Justification=6)

# ----
range_2 = Range(Domain="0 to 5", Steps=expr("x-1", "24"))
mplane_2 = MeshPlane(Boundary=rectangle.Rectangle, WidthCount=lng, HeightCount="24")  # -> Mesh, Area
flip = FlipMatrix(Data=assign_paths)
pt_4 = ConstructPoint(XCoordinate="-.2", YCoordinate=range_2, ZCoordinate=0)
series_3 = Series(Start=0, Step=1, Count="24")
heatmap_2 = LBSpatialHeatmap(values=flatten(flip), mesh=mplane_2.Mesh, legend_par=legendpar, legend_title="[°C]")  # -> mesh, legend, title, colors, legend_par; plug-in component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
concat_2 = Concatenate(FragmentA=series_3, FragmentB="h")
col_3 = Colour(RGB(18, 18, 18))

# ---- group: Results
mesh = Mesh(heatmap_2.mesh)
tag_4 = TextTag3D(Location=pt_4, Text=concat_2, Size=".15", Colour=col_3, Justification=6)
