# Grasshopper definition os_gh-template.gh (Grasshopper 1.0.8)
# plug-ins: Human, froGH
# The ECHOES Grasshopper template for definitions meant to be hosted and called through Hops. It provides colour-coded groups for GH inputs, Rhino input, function, viz, external input, output, control, UI, temp, remote and dead parts, a Python 3 helper script that reads a file and a key path, an output writer with a write toggle, and a total-area readout. A demonstration box function with floors, width, depth and height shows the pattern. A work-in-progress area holds colour palettes, viewport capture and a timber material path. The template carries the ECHOES.PARIS logo.

gi_gh_inputs = ColourSwatch(SwatchColor=RGB(255, 255, 179))  # disabled
visit_the_website = Button()  # disabled
ri_rh_inputs = ColourSwatch(SwatchColor=RGB(190, 186, 218))  # disabled
ei_external = ColourSwatch(SwatchColor=RGB(253, 180, 98))  # disabled
dir_type = ValueList({"desktop": 0, "documents": 1, "GH file path": 2, "C:": 3}, selected="GH file path")  # disabled
path_type = ValueList({"Desktop": 0, "Documents": 1, "GH file path": 2, "C:": 3}, selected="Documents")  # disabled
f_function = ColourSwatch(SwatchColor=RGB(217, 217, 217))  # disabled
c_control = ColourSwatch(SwatchColor=RGB(251, 128, 114))  # disabled
o_output = ColourSwatch(SwatchColor=RGB(128, 177, 211))  # disabled
d_dead = ColourSwatch(SwatchColor=RGB(188, 128, 189))  # disabled
t_temp = ColourSwatch(SwatchColor=RGB(179, 222, 105))  # disabled
ui_ui = ColourSwatch(SwatchColor=RGB(204, 235, 197))  # disabled
v_viz = ColourSwatch(SwatchColor=RGB(252, 205, 229))  # disabled
panel = Panel("my subdir")  # disabled
panel_2 = Panel("1")  # disabled
f_pathg = PathGenerator(type=dir_type)  # -> dir; inputs type: Int32, subDir: String; disabled
# ---------- f_pathg: C# ----------
                           /*
    froGH - a sparse collection of (in)utilities for Grasshopper

    Path Generator
    code by Alessio Erioli - value list generation based on code by James Ramsden

    froGH by Co-de-iT is licensed under a Creative Commons Attribution 4.0 International License.
    http://creativecommons.org/licenses/by/4.0/

    */
    initComp();


    String S = "";
    String root = "";
    String end = "\\";
    String eol = Environment.NewLine;

    // __________________ autoList part __________________

    // variable for the list
    Grasshopper.Kernel.Special.GH_ValueList vList;
    // tries to cast input as list
    try{

      // if the list is not the first parameter then change Input[0] to the corresponding value
      vList = (Grasshopper.Kernel.Special.GH_ValueList) Component.Params.Input[0].Sources[0];
      // Print("value list connected");
      // check if the list must be created
      //if (vList.NickName != "dir type"){
      if (!vList.NickName.Equals("dir type")){
        vList.ClearData();
        vList.ListItems.Clear();
        vList.NickName = "dir type";
        var item1 = new Grasshopper.Kernel.Special.GH_ValueListItem("desktop", "0");
        var item2 = new Grasshopper.Kernel.Special.GH_ValueListItem("documents", "1");
        var item3 = new Grasshopper.Kernel.Special.GH_ValueListItem("GH file path", "2");
        var item4 = new Grasshopper.Kernel.Special.GH_ValueListItem("C:", "3");
        vList.ListItems.Add(item1);
        vList.ListItems.Add(item2);
        vList.ListItems.Add(item3);
        vList.ListItems.Add(item4);

        vList.ListItems[0].Value.CastTo(out type);
      }
    }
    catch{
      // handles anything that is not a value list
    }


    switch(type){
      case 0:
        root = Environment.GetFolderPath(Environment.SpecialFolder.Desktop) + end;
        S = "Desktop";
        break;
      case 1:
        root = Environment.GetFolderPath(Environment.SpecialFolder.MyDocuments) + end;
        S = "Documents";
        break;
      case 2:
        GH_Document ghDoc = owner.OnPingDocument();

        if (ghDoc.IsFilePathDefined)
        {
          int nameLen = ghDoc.DisplayName.TrimEnd('*').Length + 3; // +3 accounts for the '.gh' extension
          int fileLen = ghDoc.FilePath.TrimEnd('*').Length;

          //F = ghDoc.DisplayName.TrimEnd('*');
          root = ghDoc.FilePath.Substring(0, fileLen - nameLen);
          //root = gh_d.FilePath;
          S = "GH File path";
        }
        else
        {
          Print("No path defined. Saving to Desktop until then");
          root = Environment.GetFolderPath(Environment.SpecialFolder.Desktop);
          S = "Desktop";
        }
        break;
      case 3:
        root = "C:" + end;
        S = root + end;
        break;
    }
    dir = root + (subDir != null ? (subDir + end) : "");
    Component.Message = S;
# ---------- f_pathg: C# additional code ----------
  void initComp(){
    Component.Name = "Path Generator";
    Component.NickName = "f_PathG";
    Component.Description = "generates a path based on local direcories such as Desktop, Documents, GH file path";
    Component.Params.Input[0].Name = "dir type";
    Component.Params.Input[0].Description = "directory type: 0 desktop, 1 documents, 2 GH file path, 3 C:\nconnect a value list for automatic list generation";
    Component.Params.Input[1].Name = "custom subdir";
    Component.Params.Input[1].Description = "(optional) custom subdirectory";
  }
# ---------- end f_pathg ----------
wires_and_groups = CSharpScript(
    Colors=[c_control, gi_gh_inputs, ri_rh_inputs, t_temp, f_function, ei_external, o_output, ui_ui, v_viz, d_dead],
    Enable=panel_2,
    debug=False)  # -> out; inputs Colors: list of Color, Enable: Boolean, debug: Boolean; disabled
# ---------- wires_and_groups: C# usings ----------
using System.Linq;
using System.Text;
# ---------- wires_and_groups: C# ----------
    msg.Clear();
    _debug = debug; //Set to true to have all events printed in rhino log

    if (Enable)
    {
      SetupDict(); // Create a dictionary of the input swatches
      SetEventHandlers(); // This would do the job.
    }
    else
    {
      RemoveEventHandlers();
    }

    Print(msg.ToString());


    // Component setup
    Component.Description = "Set up event handlers to color groups based on prefixes such as 'in_' and 'out_'.\n"
      + "Please insert only swatcheds directly into the Colors input\n"
      + "MIT License. Copyright Mathias Sønderskov Schaltz 2022";
    Component.Params.Input[0].Description = "Please insert only swatcheds directly into the Colors input.\nRemember to rename them";
    Component.Params.Input[1].Description = "Toggle to run...";
    Component.Params.Input[2].Description = "Set debug to true to get all the events printed in the rhino log";
# ---------- wires_and_groups: C# additional code ----------
  Dictionary<string, System.Drawing.Color> colorDict = new Dictionary<string, System.Drawing.Color>();
  StringBuilder msg = new StringBuilder();
  bool _debug = false;


  public void SetupDict()
  {
    colorDict.Clear();
    // Get all inputs to "Colors"
    IList<IGH_Param> colorSources = this.Component.Params.Input[0].Sources;
    if (colorSources.Count == 0)
    {
      throw new Exception("You forgot to setup the colors. Please input swatch components and rename them");
    }
    foreach(IGH_Param source in colorSources)
    {
      //if (source.Type.ToString() == "Grasshopper.Kernel.Types.GH_Colour")
      if (source is Grasshopper.Kernel.Special.GH_ColourSwatch)
      {
        string nickName = source.NickName.Split('_')[0].Trim() + '_';
        if(!colorDict.ContainsKey(nickName))
        {
          Grasshopper.Kernel.Special.GH_ColourSwatch swatch = (Grasshopper.Kernel.Special.GH_ColourSwatch) source;
          colorDict.Add(nickName, swatch.SwatchColour);
        }
        else
        {
          throw new Exception("Multiple swatches using the same name detected. Please rename");
        }
      }
      else
      {
        throw new Exception("Whacko! Why did you input a non-swatch into the Colors? " + source.Type.ToString());
      }

    }

    msg.AppendFormat("Set up the dictionaries with {0} colors\n", colorDict.Count);
    foreach(var pairs in colorDict)
    {
      msg.AppendFormat("{0} -> {1}\n", ("\"" + pairs.Key + "\"").PadRight(5 + colorDict.Keys.Select(k => k.Length).Max()), pairs.Value);
    }
  }

  public void SetEventHandlers()
  {

    // Always remove events first to avoid duplicates
    GrasshopperDocument.ObjectsAdded -= OnObjectsAdded;
    GrasshopperDocument.ObjectsDeleted -= OnObjectsRemoved;
    GrasshopperDocument.ObjectsDeleted -= DeleteThisComponent;

    // Attach events
    GrasshopperDocument.ObjectsAdded += OnObjectsAdded;
    GrasshopperDocument.ObjectsDeleted += OnObjectsRemoved;
    GrasshopperDocument.ObjectsDeleted += DeleteThisComponent;


    foreach(Grasshopper.Kernel.Special.GH_Group grp in GrasshopperDocument.Objects.OfType<Grasshopper.Kernel.Special.GH_Group>())
    {
      grp.ObjectChanged -= ColorGroup;
      grp.ObjectChanged += ColorGroup;

      ColorGroup(grp, null); // Make sure to run it once
    }
    msg.AppendFormat("Added the eventhandlers on {0} existing groups and on future created groups", GrasshopperDocument.Objects.OfType<Grasshopper.Kernel.Special.GH_Group>().Count());
  }

  public void OnObjectsAdded(object sender, GH_DocObjectEventArgs e)
  {
    bool any = false;
    foreach (Grasshopper.Kernel.Special.GH_Group grp in e.Objects.OfType<Grasshopper.Kernel.Special.GH_Group>())
    {
      grp.ObjectChanged -= ColorGroup;
      grp.ObjectChanged += ColorGroup;
      any = true;
    }

    DebugWrite(any ? "Group Objects Added: Attaching Events to ObjectChanged" : "Objects Added - but no groups");
  }

  //Same but reversed
  public void OnObjectsRemoved(object sender, GH_DocObjectEventArgs e)
  {
    bool any = false;
    foreach (Grasshopper.Kernel.Special.GH_Group grp in e.Objects.OfType<Grasshopper.Kernel.Special.GH_Group>())
    {
      grp.ObjectChanged -= ColorGroup;
      any = true;
    }

    DebugWrite(any ? "Group Objects Removed, removing event" : "Objects Removed - although not a group");

  }



  public void RemoveEventHandlers()
  {
    GrasshopperDocument.ObjectsAdded -= OnObjectsAdded;
    GrasshopperDocument.ObjectsDeleted -= OnObjectsRemoved;


    foreach(Grasshopper.Kernel.Special.GH_Group grp in GrasshopperDocument.Objects.OfType<Grasshopper.Kernel.Special.GH_Group>())
    {
      grp.ObjectChanged -= ColorGroup;

    }
    msg.AppendFormat("Removed event handlers on document and on {0} groups\n", GrasshopperDocument.Objects.OfType<Grasshopper.Kernel.Special.GH_Group>().Count());

  }

  public void ColorGroup(object sender, EventArgs e)
  {

    Grasshopper.Kernel.Special.GH_Group grp = sender as Grasshopper.Kernel.Special.GH_Group;
    if (grp == null) return; //not type GH_Group
    //if (!grp.NickName.EndsWith("_")) return;


    string prefix = grp.NickName.Split('_')[0].Trim() + '_';

    string prefixes = String.Join(", ", colorDict.Keys.Select(k => "\"" + k + "\""));


    if (colorDict.ContainsKey(prefix))
    {
      if (grp.NickName.EndsWith("_"))
        grp.Colour = colorDict[prefix];
      grp.NickName = grp.NickName.Replace(prefix, "");

      DebugWrite("Colored " + grp.NickName);

    }
    else
    {
      //DebugWrite("Group changed but not relevant: prefix " + prefix + " is not among " + prefixes);
    }

  }
  public void DebugWrite(string msg)
  {
    if (_debug)
    {
      Rhino.RhinoApp.WriteLine(msg);
    }
  }

  public void DeleteThisComponent(object sender, GH_DocObjectEventArgs e)
  {

    if (e.Objects.OfType<Grasshopper.Kernel.GH_Component>().Where(o => o.NickName == this.Component.NickName).Any())
    {
      DebugWrite("Removed template component. Removing all the eventhandlers");
      RemoveEventHandlers();
    }


  }
# ---------- end wires_and_groups ----------
python = GhPythonScript(open=visit_the_website)  # disabled
# ---------- python: Python ----------
""" A simple 'open in browser' script """

import webbrowser

url = 'https://github.com/echoesparis'

if open:
    webbrowser.open(url, new=2)
# ---------- end python ----------
f_pathg_2 = PathGenerator(PathType=path_type, Subdir=panel)  # disabled

# ---- group: Illustration of the default template / external input
uses_csv = FilePath("scripts/data/floor_uses.csv")
resolve = Python3Script(rel=uses_csv)  # -> out, path
# ---------- resolve: Python ----------
"""ei_ external input - make a repo-relative path absolute.

Read File needs an absolute path for its file watcher, but baking one into
the .gh would tie the definition to this machine. Resolve it against the
location of the .gh instead, exactly as the script path panel does.
"""
import os

_doc = ghenv.Component.OnPingDocument()
_gh = _doc.FilePath if _doc is not None else None
path = os.path.join(os.path.dirname(_gh), str(rel).replace("/", os.sep)) if (_gh and rel) else ""
# ---------- end resolve ----------
file = ReadFile(File=resolve.path, PerLineParse=True)
uses = Panel(file)

# ----
custom = Panel("""SP_,#ccebc5,"Seb"
CC_,#fdb462,"Claude"
""")
logo = Mesh(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)
ac = Python3Script(script="scripts\gh_template.py", run=Toggle(True), l=logo)  # -> out, s; inputs cs: list, l: list; unedited script template

# ---- group: Illustration of the default template / get keys from....
# note: the key file lives outside the repo and is never committed;
# the path is all the definition carries
api_key_file = FilePath("%USERPROFILE%/.echoes/compute.key")

# ----
panel_3 = Panel(ac.out)
panel_4 = Panel(ac.s)

# ---- group: Illustration of the default template / GH input
width = Slider(12, range=4..40)
depth = Slider(8, range=4..40)
height = Slider(3.5, range=2..6)
floors = Slider(8, range=1..30)

# ---- group: Illustration of the default template / remote
ping = Python3Script(key=api_key_file)  # -> out
# ---------- ping: Python ----------
"""h_ remote - ask the compute endpoint whether it is alive."""
import urllib.request, json

def ping(url, key, timeout=2.0):
    req = urllib.request.Request(url)
    if key:
        req.add_header("Authorization", "Bearer " + str(key))
    with urllib.request.urlopen(req, timeout=timeout) as r:
        return "%s %s" % (r.status, r.read(120).decode("utf-8", "replace"))

_url = str(url) if url else "http://127.0.0.1:5000/"
try:
    print(ping(_url, key))
except Exception as e:
    print("%s unreachable: %s" % (_url, e))
# ---------- end ping ----------
status = Panel(ping)

# ---- group: Illustration of the default template / rhino input
site_origin = Point(Point(0, 0, 0))

# ---- group: Illustration of the default template / function
xy = XYPlane(Origin=site_origin)
series = Series(Start=0, Step=height, Count=floors)
box = CenterBox(Base=xy, X=width, Y=depth, Z=height)
Z = UnitZ(Factor=series)
move = Move(Geometry=box, Motion=Z)  # -> Geometry, Transform

# ---- group: Illustration of the default template / control
write = BooleanToggle(False)

# ---- group: Illustration of the default template / viz
area = Area(Geometry=move.Geometry)  # -> Area, Centroid
bnd = Bounds(Numbers=series)
remap = RemapNumbers(Value=series, Source=bnd, Target=Domain(0, 1))  # -> Mapped, Clipped
gradient = Gradient(LowerLimit=0, UpperLimit=1, Parameter=remap.Mapped, stops=[0.15: RGB(255, 130, 160), 0.85: RGB(220, 0, 40)])
preview = CustomPreview(Geometry=move.Geometry, Material=gradient)

# ---- group: Illustration of the default template / temp
ma = MassAddition(Input=area.Area)  # -> Result, PartialResults
total_m2 = Panel(ma.Result)

# ---- group: Illustration of the default template / output
out_file = Panel("C:\Users\SP\ECHOES\compute - D\hops-functions\scripts\data\schedule.csv")
write_csv = Python3Script(write=write, path=out_file, data=area.Area)  # -> out; inputs data: list
# ---------- write_csv: Python ----------
"""o_ output - write the schedule to disk, gated by the write toggle."""
import os

def write_csv(path, rows):
    folder = os.path.dirname(path)
    if folder and not os.path.isdir(folder):
        os.makedirs(folder)
    with open(path, "w", encoding="utf-8", newline="") as f:
        f.write("level,area\n")
        for i, a in enumerate(rows):
            f.write("%d,%.3f\n" % (i, float(str(a))))
    return len(rows)

_rows = [a for a in (data or []) if a is not None]
_path = str(path) if path else ""
if not write:
    print("write = False - %d level(s) ready, nothing written" % len(_rows))
elif not _path:
    print("no path given")
else:
    try:
        print("wrote %d level(s) to %s" % (write_csv(_path, _rows), _path))
    except Exception as e:
        print("could not write %s: %s" % (_path, e))
# ---------- end write_csv ----------
written = Panel(write_csv)

# ---- group: Illustration of the default template / dead
old_label_maker = Concatenate()  # disabled

# ---- group: Illustration of the default template / UI
mode = ValueList({"massing", "areas"}, selected="massing")

# ----
ig = Data(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)

# ---- group: WIP
# IG square
# Swis721 Cn BT
# Bahnschrift Condensed
# Bahnschrift SemiBold Condensed
# SLF-RHN Architect
# H1
# H2
# H3
panel_5 = Panel("Wood\Pine\Maritime pine.rmtl")
panel_6 = Panel("C:\Users\SP\AppData\Roaming\McNeel\Rhinoceros\7.0\Localization\en-US\Render Content\")
path = FilePath("C:\Users\SP\AppData\Roaming\McNeel\Rhinoceros\8.0\Localization\en-US\Render Content\")
colorbrewer_set3_n_12 = Panel("""#8dd3c7
#ffffb3
#bebada
#fb8072
#80b1d3
#fdb462
#b3de69
#fccde5
#d9d9d9
#bc80bd
#ccebc5
#ffed6f""")
concat = Concatenate(FragmentA=panel_6, FragmentB=panel_5)
bois = ColourSwatch(SwatchColor=RGB(143, 134, 117))
_121212 = ColourSwatch(SwatchColor=RGB(18, 18, 18))
_80b1d3 = ColourSwatch(SwatchColor=RGB(128, 177, 211))
d9d9d9 = ColourSwatch(SwatchColor=RGB(217, 217, 217))
_999999 = ColourSwatch(SwatchColor=RGB(153, 153, 153))
_8dd3c7 = ColourSwatch(SwatchColor=RGB(141, 211, 199))
bc80bd = ColourSwatch(SwatchColor=RGB(188, 128, 189))
fb8072 = ColourSwatch(SwatchColor=RGB(251, 128, 114))
b3de69 = ColourSwatch(SwatchColor=RGB(179, 222, 105))
bebada = ColourSwatch(SwatchColor=RGB(190, 186, 218))
ccebc5 = ColourSwatch(SwatchColor=RGB(204, 235, 197))
fdb462 = ColourSwatch(SwatchColor=RGB(253, 180, 98))
fccde5 = ColourSwatch(SwatchColor=RGB(252, 205, 229))
f0f0f0 = ColourSwatch(SwatchColor=RGB(240, 240, 240))
ffed6f = ColourSwatch(SwatchColor=RGB(255, 237, 111))
ffffb3 = ColourSwatch(SwatchColor=RGB(255, 255, 179))
black = ColourSwatch(SwatchColor=RGB(0, 0, 0))
white = ColourSwatch(SwatchColor=RGB(255, 255, 255))
timber_lines = Colour(bois)
timber = Data(concat)
panel_7 = Panel("1080x1080")
number_slider = Slider(82, range=0..1000)  # disabled
number_slider_2 = Slider(89, range=0..1000)  # disabled
f_vc2f = ViewCaptureToFile(
    FilePath="C:\Users\SP\Desktop\erase\",
    FileName="screenshot.png",
    ViewportName="Perspective",
    ImageSize="1920x1080",
    Scale=1,
    Grid=False,
    Axes=False,
    Widget=False,
    Capture=Button())  # disabled
mod_viewport = ModifyViewport(ViewportName="Perspective", DisplayMode="DarkMode", CameraLensLength="35", AnimateRestore=False, RestoreFrames=10)  # disabled
meshtoscreen = RenderMeshToScreen(Mesh=logo, Location="0,0", ScaleFactor=1, Color=black, Depth=0.95, Fixed=True, m_scWithvp=False)
crvtoscreen = RenderCurveToScreen(
    Curve=ig,
    Location="0,0",
    ScaleFactor=1,
    Color=black,
    Thickness="1",
    Depth=Slider(0.936, range=0.85..0.999),
    Fixed=True,
    m_scWithvp=False)  # disabled
py3 = Python3Script(X=number_slider, Y=number_slider_2)  # disabled
# ---------- py3: Python ----------
"""Grasshopper Script Instance"""
import System
import Rhino as rc
import Grasshopper as gh

import rhinoscriptsyntax as rs


class MyComponent(Grasshopper.Kernel.GH_ScriptInstance):
        
    def RunScript(self, X, Y):
        self.pt = rc.Geometry.Point2d(X,Y)
        
    def DrawForeground(self,sender,arg):
        
        # Check component preview/locked, active GH document and Rhino viewport
        if (not ghenv.Component.Hidden and not ghenv.Component.Locked 
            and ghenv.Component.OnPingDocument() == gh.Instances.ActiveCanvas.Document
            and arg.Viewport.Id == arg.RhinoDoc.ActiveDoc.Views.ActiveView.ActiveViewportID):
            
            # Convert image encoded as byte string to .NET bitmap
            string = "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"
            
            byteArray = System.Convert.FromBase64String(string)
            bitmap1 = System.Drawing.ImageConverter().ConvertFrom(byteArray)
            
            # Convert to RhinoCommon bitmap and draw sprite
            bitmap2 = rc.Display.DisplayBitmap(bitmap1)
            arg.Display.DrawSprite(bitmap2,self.pt,64,64)
            
    def __exit__(self):
        rc.Display.DisplayPipeline.DrawForeground -= self.DrawForeground
        
    def __enter__(self):
        rc.Display.DisplayPipeline.DrawForeground += self.DrawForeground
# ---------- end py3 ----------
