# Grasshopper definition urb_massing-typologies.gh (Grasshopper 1.0.8)
# plug-ins: Human, Hops, Octopus, Weaverbird
# Urban massing typology tool that chains several Hops functions: it calls solar envelope, building typology generator (xy1 with substrate number, seed and two angles), direct sun hours, sky view and view analysis definitions on one site curve. Winter and summer sun vectors, points of interest and context meshes are assembled with Weaverbird, and results come back as DSHs, DSHw, SVFg and VAL values and coloured meshes.

list = ValueList({"C:\Users\SP\ECHOES\compute - D\appserver\src\files\", "https://compute.echoes.paris/"}, selected="C:\Users\SP\ECHOES\compute - D\appserver\src\files\")
substrate_number = Slider(58, range=0..100)
substrate_seed = Slider(100, range=0..300)
angle_1 = Slider(84.8, range=0..360)
number_slider = Slider(28.3, range=0..90)
toggle = BooleanToggle(True)
concat = Concatenate(FragmentA=list, FragmentB="urb_type-xy1.gh")
site_crv = Curve(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)
site_crv_2 = Curve(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)
hops = Hops(
    _Path=concat,
    _Enabled=toggle,
    Key="default",
    SiteCrv=site_crv,
    N=substrate_number,
    Seed=substrate_seed,
    BaseAngle=45,
    Angle1=angle_1,
    Angle2=number_slider,
    Setback=3,
    MaxArea=4000,
    ChamferR=4,
    ChamferA=60,
    DepthMin=7,
    DepthMax=12,
    MinCourtDim=4,
    MinBatArea=400,
    MaxBatArea=20000,
    MaxFormFactor=5.6,
    CacheResultsInMemory=False,
    CacheSolveResults=False,
    RemoteDefinitionLocation="C:\Users\SP\ECHOES\compute - D\appserver\src\files\urb_type-xy1.gh",
    RemoteSolveVersion=(0, 1, 0),
    ShowInput_Enabled=True,
    ShowInput_Path=True,
    SynchronousSolve=True)  # -> Readme, Bat, Ground, Green
number_slider_2 = Slider(5, range=0..10)
d9d9d9 = ColourSwatch(SwatchColor=RGB(217, 217, 217))
ccebc5 = ColourSwatch(SwatchColor=RGB(204, 235, 197))
black = ColourSwatch(SwatchColor=RGB(0, 0, 0))
custom_mesh_settings = SettingsCustom(
    StitchSeams=True,
    SimplePlanes=False,
    Refine=True,
    MinCount=16,
    MaxCount=400,
    AspectRatio=20,
    MaxDistance=0,
    MaxAngle=20,
    MinEdge=number_slider_2,
    MaxEdge=number_slider_2)
entwine = Entwine(Branch00=hops.Bat, Branch01=hops.Ground, Branch02=hops.Green, FlattenInputs=True)
entwine_2 = Entwine(Branch00=black, Branch01=d9d9d9, Branch02=ccebc5, FlattenInputs=True)
concat_2 = Concatenate(FragmentA=list, FragmentB="urb_type-z_solar-envelope.gh")
previewmat = CustomPreviewMaterials(Geometry=entwine, DiffuseColor=entwine_2)
brep = Brep(hops.Bat)
mesh = MeshBrep(Brep=[hops.Ground, hops.Green], Settings=custom_mesh_settings)
hops_2 = Hops(
    _Path=concat_2,
    _Enabled=toggle,
    Bat=brep,
    Geometry={Plane=PlaneXY(0, 0, 100), Size=Domain2(u=0..200, v=0..200)},
    EpwUrl="https://energyplus-weather.s3.amazonaws.com/europe_wmo_region_6/FRA/FRA_Paris.Orly.071490_IWEC/FRA_Paris.Orly.071490_IWEC.zip",
    CacheResultsInMemory=False,
    CacheSolveResults=False,
    RemoteDefinitionLocation="C:\Users\SP\ECHOES\compute - D\appserver\src\files\urb_type-z_solar-envelope.gh",
    RemoteSolveVersion=(0, 1, 0),
    ShowInput_Enabled=True,
    ShowInput_Path=True,
    SynchronousSolve=True)
mesh_2 = MeshBrep(Brep=hops.Green, Settings=custom_mesh_settings)
mjoin = MeshJoin(Meshes=flatten(mesh))
mjoin_2 = MeshJoin(Meshes=mesh_2)
mjoin_3 = MeshJoin(Meshes=hops_2)
mesh_3 = MeshBrep(
    Brep=brep,
    Settings={GridMaxCount=0, GridMinCount=16, JaggedSeams=False, MaxEdgeLength=0, MinEdgeLength=0.0001, MinTolerance=0, Refine=True, RefineAngle=0, RelativeTolerance=0.65, SimplePlanes=True, Tolerance=0})
toggle_2 = BooleanToggle(True)
wbvertices = WeaverbirdsVerticesComponent(MeshClosedPolylinesGroup=mesh_3, Weld=True)
concat_3 = Concatenate(FragmentA=list, FragmentB="ee_VIEW.gh")
Z = UnitZ(Factor=1)
list_2 = ValueList({"Horiz Radial": 0, "Horiz 30°": 1, "Spherical": 2, "Sky Exposure": 3, "Sky View": 4}, selected="Sky View")
concat_4 = Concatenate(FragmentA=list, FragmentB="ee_SKY.gh")

summersunvec = Text([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])
wintersunvec = Text(["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", "{-0.770466,0.636526,-0.034891};{-0.615339,0.773538,-0.151645};{-0.418378,0.875786,-0.240746};{-0.192929,0.936254,-0.293609};{0.045659,0.950822,-0.306354};{0.281137,0.918497,-0.278075};{0.497453,0.841489,-0.210799};{0.67992,0.725039,-0.109666}", "{-0.842105,0.52916,-0.104159};{-0.693152,0.680946,-0.236331};{-0.496962,0.798601,-0.339508};{-0.266884,0.874085,-0.405892};{-0.018592,0.902239,-0.430834};{0.230997,0.881131,-0.412611};{0.46488,0.81216,-0.352538};{0.667112,0.700055,-0.254726};{0.823917,0.552423,-0.126448}"])
data = Data("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")

meshray = MeshRay(Mesh=mjoin_3, Point=wbvertices, Direction=Z)  # -> Point, Hit
pois = Point([Point(847.1009357, 582.3615808, 0), Point(302.3209996, -396.2593273, 0), Point(-445.227634, 63.95149364, 0), Point(-346.7578842, 1478.777416, 0), Point(169.1065988, 228.1006003, 0)])
concat_5 = Concatenate(FragmentA=list, FragmentB="ee_sun.gh")
vec2pt = Vector2Pt(PointA=wbvertices, PointB=meshray.Point, Unitize=False)  # -> Vector, Length
wbthicken = WeaverbirdsMeshThicken(MeshCurves=graft(mesh_3), Distance=simplify(vec2pt.Vector), OffsetType=0)
faceb = FaceBoundaries(Mesh=wbthicken)  # -> graft(Boundaries)
mjoin_4 = MeshJoin(Meshes=flatten(wbthicken))
boundary = BoundarySurfaces(Edges=faceb)  # -> flatten(Surfaces)
mesh_4 = MeshBrep(Brep=boundary, Settings=custom_mesh_settings)
c_script = CSharpScript(mesh=mjoin_4)  # -> base64Draco; inputs mesh: Mesh
# ---------- c_script: C# ----------
    var options = new Rhino.FileIO.DracoCompressionOptions();
    options.CompressionLevel = 5;
    options.IncludeTextureCoordinates = false;
    options.IncludeVertexColors = false;

    var compressed = Rhino.FileIO.DracoCompression.Compress(mesh, options);
    base64Draco = compressed.ToBase64String();
# ---------- end c_script ----------
mjoin_5 = MeshJoin(Meshes=mesh_4)
hops_3 = Hops(
    _Path=concat_5,
    _Enabled=toggle_2,
    Key="default",
    Geometry=mjoin_5,
    Context_d=c_script,
    SunVec=data,
    Timestep=1,
    CacheResultsInMemory=False,
    CacheSolveResults=False,
    RemoteDefinitionLocation="C:\Users\SP\ECHOES\compute - D\appserver\src\files\ee_sun.gh",
    RemoteSolveVersion=(0, 1, 0),
    ShowInput_Enabled=True,
    ShowInput_Path=True,
    SynchronousSolve=True)  # -> Readme, Mesh, LegMesh, LegPar, MeshResults, Metrics, Values
hops_4 = Hops(
    _Path=concat_5,
    _Enabled=toggle_2,
    Key="default",
    Geometry=mjoin_5,
    Context_d=c_script,
    SunVec=data,
    Timestep=1,
    CacheResultsInMemory=False,
    CacheSolveResults=False,
    RemoteDefinitionLocation="C:\Users\SP\ECHOES\compute - D\appserver\src\files\ee_sun.gh",
    RemoteSolveVersion=(0, 1, 0),
    ShowInput_Enabled=True,
    ShowInput_Path=True,
    SynchronousSolve=True)  # -> Readme, Mesh, LegMesh, LegPar, MeshResults, Metrics, Values; disabled
hops_5 = Hops(
    _Path=concat_4,
    _Enabled=toggle_2,
    Key="default",
    ViewType=list_2,
    Geometry=mjoin,
    Context_d=c_script,
    CacheResultsInMemory=False,
    CacheSolveResults=False,
    RemoteDefinitionLocation="C:\Users\SP\ECHOES\compute - D\appserver\src\files\ee_SKY.gh",
    RemoteSolveVersion=(0, 1, 0),
    ShowInput_Enabled=True,
    ShowInput_Path=True,
    SynchronousSolve=True)  # -> Readme, Analysis, Mesh, LegMesh, LegPar, MeshResults, Metrics, Values
hops_6 = Hops(
    _Path=concat_3,
    _Enabled=toggle_2,
    Key="default",
    POIs=pois,
    Geometry=mjoin_5,
    Context_d=c_script,
    CacheResultsInMemory=False,
    CacheSolveResults=False,
    RemoteDefinitionLocation="C:\Users\SP\ECHOES\compute - D\appserver\src\files\ee_VIEW.gh",
    RemoteSolveVersion=(0, 1, 0),
    ShowInput_Enabled=True,
    ShowInput_Path=True,
    SynchronousSolve=True)  # -> Readme, Mesh, LegMesh, LegPar, MeshResults, Metrics, Values
panel = Panel(",")  # disabled
split = TextSplit(Text=hops_3.MeshResults, Separators=",")
split_2 = TextSplit(Text=hops_4.MeshResults, Separators=panel)  # disabled
split_3 = TextSplit(Text=hops_5.MeshResults, Separators=",")
split_4 = TextSplit(Text=hops_6.MeshResults, Separators=",")
ma = MassAddition(Input=split)  # -> Result, PartialResults
ma_2 = MassAddition(Input=split_2)  # -> Result, PartialResults; disabled
ma_3 = MassAddition(Input=split_4)  # -> Result, PartialResults
ma_4 = MassAddition(Input=split_3)  # -> Result, PartialResults
one_over_x = OneOverX(Value=ma_2.Result)  # disabled
one_over_x_2 = OneOverX(Value=ma_3.Result)
one_over_x_3 = OneOverX(Value=ma_4.Result)
dshs = Number(ma.Result)
dshw = Number(one_over_x)  # disabled
val = Number(one_over_x_2)
svfg = Number(one_over_x_3)
entwine_3 = Entwine(Branch00=hops_6.Mesh, Branch01=hops_4.Mesh, Branch02=hops_5.Mesh, Branch03=hops_3.Mesh, FlattenInputs=True)
number_slider_3 = Slider(300, range=0..300)
lng = ListLength(List=flatten(entwine_3))
octopus = Octopus(Phenotype=mjoin_4, OctopusData_gene=[number_slider, angle_1], OctopusData_obj=[dshw, dshs, svfg, val])
series = Series(Start=number_slider_3, Step=number_slider_3, Count=lng)
X = UnitX(Factor=series)
Y = UnitY(Factor=series)
Z_2 = UnitZ(Factor=series)
move = Move(Geometry=flatten(entwine_3), Motion=X)  # -> Geometry, Transform
