# Grasshopper definition viz_bivariate-choropleth_example.gh (Grasshopper 1.0.8)
# plug-ins: Hops
# Example of the viz_bivariate-choropleth Hops function on a simple map: the 20 Paris arrondissements (outlines from opendata.paris.fr, internalised in km around Notre-Dame), coloured by population density 2021 against population change 2010-2021 (INSEE census figures), by terciles, with the legend placed beside the map. The server is chosen in the list: the local appserver folder or compute.echoes.paris.

# ---- group: Paris arrondissements: outlines (opendata.paris.fr) and INSEE populations
# Outlines: opendata.paris.fr 'arrondissements' (2026-10-25), WGS84 to km around Notre-Dame. Populations: INSEE census 2010 and 2021, via fr.wikipedia 'Arrondissements de Paris'. Areas include the Bois de Vincennes (12e) and Bois de Boulogne (16e).
arrondissements = Curve([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])
population_2021 = Panel("""15919
21119
32793
28324
56841
40209
47947
35123
58951
83543
142583
140954
178350
136368
227746
162061
164413
188446
181616
189805""")
population_2010 = Panel("""17308
23009
35652
28012
60938
43451
57974
41280
60139
95394
153202
144262
181532
138299
236715
171124
169325
202685
186652
196880""")

# ---- group: title and text colour of the map labels
title_point = Point(Point(-6, 5.6, 0))
text_colour = ColourSwatch(SwatchColor=RGB(70, 70, 70))
title = TextTag3D(
    Location=title_point,
    Text="Paris: density 2021 x population change 2010-2021",
    Size="0.35",
    Colour=text_colour,
    Justification=7)

# ---- group: data: density 2021 and change 2010-2021 per arrondissement
boundary = BoundarySurfaces(Edges=arrondissements)
subtraction = Subtraction(A=population_2021, B=population_2010)
area = Area(Geometry=boundary)  # -> Area, Centroid
density = Division(A=population_2021, B=area.Area)
division = Division(A=subtraction, B=population_2010)
change = Multiplication(A=division, B="100")

# ---- group: map labels: arrondissement numbers
panel = Panel("""1
2
3
4
5
6
7
8
9
10
11
12
13
14
15
16
17
18
19
20""")
arrondissement_numbers = TextTag3D(Location=area.Centroid, Text=panel, Size="0.25", Colour=text_colour, Justification=7)

# ---- group: Hops call: viz_bivariate-choropleth (server, palette, classes, legend place)
list = ValueList({"C:\Users\SP\ECHOES\compute - D\appserver\src\files\", "https://compute.echoes.paris/"}, selected="C:\Users\SP\ECHOES\compute - D\appserver\src\files\")
concat = Concatenate(FragmentA=list, FragmentB="viz_bivariate-choropleth.gh")
palette = ValueList({"grey-gold-purple": 0, "pink-blue": 1, "teal-purple": 2, "blue-green": 3}, selected="teal-purple")
classes = ValueList({"equal intervals": 0, "terciles": 1}, selected="terciles")
legend_plane = Plane(PlaneXY(11, -3.5, 0))
hops = Hops(
    _Path=concat,
    _Enabled=Toggle(True),
    ColSys=palette,
    Discrete=Toggle(True),
    X_label="density 2021 (inh./km2)",
    X_data=density,
    Y_label="change 2010-2021 (%)",
    Y_data=change,
    Classes=classes,
    L_plane=legend_plane,
    L_size="3",
    CacheResultsInMemory=False,
    CacheSolveResults=False,
    RemoteDefinitionLocation="C:\Users\SP\ECHOES\compute - D\appserver\src\files\viz_bivariate-choropleth.gh",
    RemoteSolveVersion=(0, 1, 0),
    ShowInput_Enabled=True,
    ShowInput_Path=True,
    SynchronousSolve=True)  # -> Colors, Mesh, LPt, LText, LJust

# ---- group: preview: coloured districts, legend mesh and labels
preview = CustomPreview(Geometry=boundary, Material=simplify(hops.Colors))
mesh = Mesh(hops.Mesh)
tag = TextTag3D(
    Location=hops.LPt,
    Text=hops.LText,
    Size="0.22",
    Colour=ColourSwatch(SwatchColor=RGB(70, 70, 70)),
    Justification=hops.LJust)
