# Grasshopper definition viz_seaborn.gh (Grasshopper 1.0.8)
# plug-ins: Human UI, Human, Hops, LadybugGrasshopper
# Client for a Python plotting service built on seaborn, called through Hops: it sends sample or weather data (iris, diamonds, a city weather series) with plot settings such as plot type (histplot, boxplot), x and y columns, hue and palette, and receives the figure as a base64 image string that is decoded and shown, saved as a png or placed in a Grasshopper window. Includes start commands for the local and remote server and a preset palettes call.

# ---- group: local
# conda activate py38
# cd C:\Users\SP\Documents\GitHub\monsieurpablo\seaborn_grasshopper
# python app.py
# conda activate python-server
# cd C:\Users\SP\ECHOES\compute - D\python-server
# python app.py
panel = Panel("http://127.0.0.1:5000/")

# ----
# http://py.echoes.paris/
panel_2 = Panel("http://127.0.0.1:5000/")
concat = Concatenate(FragmentA=panel_2, FragmentB="seaborn/")
list = ValueList({"relational", "distribution", "categorical"}, selected="categorical")
concat_2 = Concatenate(FragmentA=panel_2, FragmentB="presets")
hops = Hops(
    _Path=concat_2,
    _Enabled=Toggle(True),
    PlotTypes=list,
    PaletteTypes="default",
    CacheResultsInMemory=False,
    CacheSolveResults=False,
    RemoteDefinitionLocation="http://127.0.0.1:5000/presets",
    RemoteSolveVersion=(0, 1, 0),
    ShowInput_Enabled=True,
    ShowInput_Path=True,
    SynchronousSolve=False)  # -> AvailablePlots, AvailablePalettes
series = Series(Start=0, Step=1, Count=10)
list_2 = ValueList({"anscombe", "diamonds", "fmri", "penguins", "rocket_r", "ticks", "tips", "brain_networks", "planets", "iris", "titanic"}, selected="iris")
series_2 = Series(Start=0, Step=series, Count=10)  # -> simplify(Series)
concat_3 = Concatenate(FragmentA=panel_2, FragmentB="dt_to_df")
concat_4 = Concatenate(FragmentA=panel_2, FragmentB="example_data")
panel_3 = Panel(hops.AvailablePlots)
panel_4 = Panel(hops.AvailablePalettes)
hops_2 = Hops(
    _Path=concat_4,
    _Enabled=Toggle(False),
    DatasetName=list_2,
    CacheResultsInMemory=False,
    CacheSolveResults=False,
    RemoteDefinitionLocation="http://127.0.0.1:5000/example_data",
    RemoteSolveVersion=(0, 1, 0),
    ShowInput_Enabled=True,
    ShowInput_Path=True,
    SynchronousSolve=True)
hops_3 = Hops(
    _Path=concat_3,
    DataAsTree=series_2,
    TreeStructureLabels=series,
    Datatype=series,
    CacheResultsInMemory=False,
    CacheSolveResults=False,
    RemoteDefinitionLocation="http://127.0.0.1:5000/dt_to_df",
    RemoteSolveVersion=(0, 1, 0),
    ShowInput_Enabled=False,
    ShowInput_Path=True,
    SynchronousSolve=True)
diamonds = Data("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")
iris = Data("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")
list_3 = ValueList({"LONDON": 0, "NEW_YORK": 1, "SYDNEY": 2, "MEDELLIN": 3, "BERLIN": 4}, selected="NEW_YORK")
item = ListItem(List=panel_4, Index=Slider(0, range=0..10), Wrap=False)
cluster = Cluster(city=list_3)
list_4 = ValueList({"catplot", "stripplot", "swarmplot", "boxplot", "violinplot", "boxenplot", "pointplot", "barplot", "countplot", "displot", "histplot", "kdeplot", "lineplot", "relplot", "scatterplot"}, selected="histplot")
list_5 = ValueList({"catplot", "stripplot", "swarmplot", "boxplot", "violinplot", "boxenplot", "pointplot", "barplot", "countplot", "displot", "histplot", "kdeplot", "lineplot", "relplot", "scatterplot"}, selected="histplot")
list_6 = ValueList({"deep", "muted", "pastel", "bright", "dark", "colorblind", "BrBG", "PRGn", "PiYG", "PuOr"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}, selected="Accent")
list_7 = ValueList({"catplot", "stripplot", "swarmplot", "boxplot", "violinplot", "boxenplot", "pointplot", "barplot", "countplot", "displot", "histplot", "kdeplot", "lineplot", "relplot", "scatterplot"}, selected="boxplot")
panel_5 = Panel("frequency")
toggle = BooleanToggle(True)
panel_6 = Panel("season")
panel_7 = Panel("price")
concat_5 = Concatenate(FragmentA=concat, FragmentB=list_7)
concat_6 = Concatenate(FragmentA=panel_2, FragmentB=list_4)
panel_8 = Panel("drybulb")
concat_7 = Concatenate(FragmentB=list_5)
panel_9 = Panel("cut")
panel_10 = Panel("stack")
hops_4 = Hops(
    _Path=concat_7,
    Dataframe=cluster,
    XAxis="drybulb",
    Hue="season",
    Stat="count",
    Cumulative=False,
    Multiple="layer",
    Element="bars",
    Fill=True,
    Shrink=1,
    KDE=False,
    Legend=True,
    Palette="deep",
    Despine="{}",
    AdditionalArguments="{}",
    AxisArguments="{}",
    Plot=Toggle(True),
    CacheResultsInMemory=False,
    CacheSolveResults=True,
    RemoteDefinitionLocation="https://seaborn-gh.herokuapp.com/histplot",
    RemoteSolveVersion=(0, 1, 0),
    ShowInput_Enabled=False,
    ShowInput_Path=True,
    SynchronousSolve=True)  # disabled
hops_5 = Hops(
    _Path=concat_5,
    _Enabled=Toggle(False),
    Dataframe=iris,
    XAxis="sepal_length",
    YAxis="sepal_width",
    Palette="deep",
    Despine="{}",
    AdditionalArguments="{}",
    AxisArguments="{}",
    Plot=Toggle(True),
    CacheResultsInMemory=False,
    CacheSolveResults=False,
    RemoteDefinitionLocation="http://127.0.0.1:5000/seaborn/boxplot",
    RemoteSolveVersion=(0, 1, 0),
    ShowInput_Enabled=True,
    ShowInput_Path=True,
    SynchronousSolve=True)  # disabled
toggle_2 = BooleanToggle(False)  # disabled
panel_11 = Panel("box_plot.png")  # disabled
str2img = GhPythonScript(img_str=hops_4, file_name="hist.png", run=Toggle(False))  # -> full_path; inputs run: Boolean; disabled
# ---------- str2img: Python ----------
__author__ = "pablo"
__version__ = "2022.09.01"

import os

current_folder = os.path.dirname(ghenv.Component.OnPingDocument().FilePath)
folder = folder_ if folder_ else current_folder
full_path = os.path.join(folder, file_name) 

if _run:
    # or, more concisely using with statement
    with open(full_path, "wb") as fh:
        fh.write(img_str.decode('base64'))
# ---------- end str2img ----------
str2img_2 = GhPythonScript(file_name=panel_11, run=toggle_2)  # -> full_path; inputs run: Boolean; disabled; same code as str2img
rec = Rectangle({Plane=PlaneXY(328.7539267, 529.8010471, 0), Size=Domain2(u=-252.0209424..252.0209424, v=-201.3403141..201.3403141)})  # disabled
img = ImportImage(Rectangle=rec)  # disabled
str2img_3 = DeserializeImageFromString()
panel_12 = Panel("C:\Users\SP\ECHOES\common - D\Identity\LOGOS\e_logo_dm_400_p.png")

# ---- group: SP
number_slider = Slider(0.5, range=0..1)
multiplication = Multiplication(A="1280", B=number_slider)
multiplication_2 = Multiplication(A="960", B=number_slider)
image = CreateImage(ImageSource=panel_12, ImageWidth=multiplication, ImageHeight=multiplication_2)
setimg = SetImage(ImageToModify=image, NewImagePath=str2img_3)
launchwin = LaunchWindow(
    Show=Toggle(False),
    Name="Control Window",
    Width=expr("x*1.1", multiplication),
    Height=expr("x*1.2", multiplication_2),
    ChildStatus=0,
    EnableHorizScroll=False)
addelems = AddElements(Window=launchwin, Elements=flatten(image), DoVLChecking=True)  # -> AddedElements, ElementNames

# ----
rec_2 = Rectangle({Plane=PlaneXY(328.7539267, 112.3769634, 0), Size=Domain2(u=-252.0209424..252.0209424, v=-201.3403141..201.3403141)})
img_2 = ImportImage(File=str2img_3, Rectangle=rec_2)

imageviewer = LBImageViewer(ImagePath_=str2img_3, _scale_=1, DisableClickable=False, SaveImgWithCoords=False, scale=1)  # -> ImagePath, Values, GIF

# ==== cluster Cluster
city = ClusterInput()
new_york = Text("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")
london = Text("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")
sydney = Text("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")
medellin = Text("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")
berlin = Text("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")
merge = Merge(Data1=london, Data2=new_york, Data3=sydney, Data4=medellin, Data5=berlin)
city_2 = Integer(city)
item = ListItem(List=merge, Index=city_2, Wrap=True)
sample_csv_data = Text(item)
sample_csv_data_2 = ClusterOutput(sample_csv_data)
