# Grasshopper definition vm_procedural-forestry_example.gh (Grasshopper 1.0.7)
# plug-ins: Wombat, Hops
# Example client of the procedural urban forestry Hops function: terrain, depths, buildings, obstacles and a tree database from Gene Pool are sent with a seed and a planting strategy to the Hops component. The returned trunks and foliage are meshed and previewed, with a timber material and lines, and pt_i and pt_r give initial and relaxed tree positions.

hops = Hops(
    GetString="key_echoes",
    CacheResultsInMemory=True,
    CacheSolveResults=True,
    RemoteDefinitionLocation="C:\Users\SP\OneDrive - ECHOES\secrets.gh",
    RemoteSolveVersion=(0, 1, 0),
    ShowInput_Enabled=False,
    ShowInput_Path=False,
    SynchronousSolve=True)

genes = GenePool(Decimals=0, Maximum=20, Minimum=0, Value=[8.997399448, 11.30386057, 5.711469737, 14.41970399, 14.53370184, 5.288109074])
tree_db = Data(["Type;Species;Variety / Cultivar;French common name;Size class;Development state;Growing speed;Total height (m);Trunk diameter (cm);Crown height (m);Crown diameter (m);Shape of the crown;Leaf persistency;Flowering (months);Fructification (seasons);Albedo of the crown - summer (RGB);Reaction to cut;Drought tolerance;Resistance to urban pollution;Resistance to salt;Adaptation to dry soils;Adaptation to fresh soils;Adaptation to humid soils;Adaptation to calcareous/alcalin soils;Adaptation to acid soils;Adaptation to Ph neutral soils;Adaptation to light soils (a.g.sandy);Adaptation to heavy soils (e.g. clay);Minimal soil depht (m);Minimal ground from the trunk (m);Optimal light expositions;Water needs;Minimal distance from buildings (m);Minimal distance from other trees (m);Optimal distance from other trees (m);Distance from footpaths (m);Minimal distance  from aboveground networks (m);Distance from underground networks (m);Types of climate;Original region;Introduction in Europe (date);Quality of shadow;Stomatic resistance (s/m) - leaf;Stomatic resistance (s/m) - canopy;Evapotranspiration effect;Polluants absorption;Caractéristiques gênantes", "Acer;pseudoplatanus;;Érable sycomore;1ere taille (> 12m);Adult;Fast;14.84;90;12.82;13;ovoïde;Decidous;May;Summer;70,116,77;;;Sensible;No;Not too dry;Yes;/;Yes;No;Yes;Yes;Non;2;1.5;Sun, half-shaded;;8;8;10;1.5;3.45;2.45;;Hemisphere North;/;High;;;;;", "Celtis;australis;;Micocoulier de Provence;1ere taille (> 12m);Adult;Normal;17.35;73;14.1;16;ovoïde;Decidous;September, October;Summer;89,104,73;;;/;No;Yes;No;No;Yes;Yes;Yes;No;Yes;2;1.5;Sun;;8;8;10;1.5;3.365;2.365;;Sud Europe, mediterranean regions, Western Asia, North Africa;/;Medium;;;;;", "Platanus;occidentalis;;;1ere taille (> 12m);Adult;Fast;20;93;16.5;15;ovoïde;Decidous;May;Autumn;61,102,68;;;/;Yes;Not too dry;Yes;Yes;Yes;No, but ok if slightly acid;Yes;Yes;Yes;2;1.5;Sun;;8;8;10;1.5;3.465;2.465;;North-East America;1500;/;;;;;", "Platanus;orientalis;;Platane d'Orient;1ere taille (> 12m);Adult;Fast;43;287;36;29;ovoïde;Decidous;June;Autumn;64,104,70;;;/;Yes;No, but it can resist for short periods;Yes;Yes;Yes, best configuration;No, but ok if slightly acid;Yes;Yes;Yes;2;1.5;Sun;;8;8;10;1.5;4.435;3.435;;Sud-East Europe (Balkans);/;/;;;;;", "Sophora;japonica;;Sophora du Japon;1e grandeur;Adult;Fast;22.7;105;18.3;17.5;ovoïde;Decidous;Summer;Autumn;61,98,64;;;/;/;No;Yes ;Yes;No;Yes;Yes;Yes;Yes;2;1.5;Sun, half-shaded;;8;8;10;1.5;3.525;2.525;;South Asia;1747;Low;;;;;", "Acer ;Campestre;;ÉRABLE CHAMPÊTRE;2eme taille, entre 6 et 12;Adult;Normal;10.62;77;8.72;10;ovoïde;Decidous;May;Summer;51,136,79;;;/;Yes;Not too dry;Yes;Not too humid;No;No;Yes;Yes;Yes;1.5;1.5;Sun, half-shaded;;4;6;8;1.5;3.385;2.385;;Europe, East Asia;/;Medium;;;;;"])

profondeurs = Number([4.439872423, 1.329430009, 0.7130092511, 0.1363635063, 2.765650169, 6, 2.006023007, 3.598498185, 5.242137734])
obstacles = Brep(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)
terre = Curve([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])
bat = Curve([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])

boundary = BoundarySurfaces(Edges=bat)
Z = UnitZ(Factor="31")
extr = Extrude(Base=boundary, Direction=Z)

list = ValueList({"Random": "0", "Boundaries": "1", "Clusters (3)": "2.3", "Clusters (5)": "2.5", "Grid (20m)": "3.20.0", "Grid (30m)": "3.30.0"}, selected="Clusters (5)")
hops_2 = Hops(
    Key=hops,
    Soils=terre,
    Depths=profondeurs,
    Buildings=bat,
    Seed=Slider(110, range=0..110),
    Obstacles=obstacles,
    Tree_DB=tree_db,
    Tree_N=genes,
    Strategy=list,
    CacheResultsInMemory=True,
    CacheSolveResults=True,
    RemoteDefinitionLocation="https://compute.echoes.paris/vm_procedural-urban-forestry.gh",
    RemoteSolveVersion=(0, 1, 0),
    ShowInput_Enabled=False,
    ShowInput_Path=False,
    SynchronousSolve=True)  # -> Readme, Areas, Pt_i, Pt_r, D_b, Foliage, Trunk, Roots
hops_3 = Hops(
    Key=hops,
    CacheResultsInMemory=True,
    CacheSolveResults=True,
    RemoteDefinitionLocation="https://compute.echoes.paris/os_key-server.gh",
    RemoteSolveVersion=(0, 1, 0),
    ShowInput_Enabled=False,
    ShowInput_Path=False,
    SynchronousSolve=True)  # -> Valid, Message
panel = Panel([hops_3.Valid, hops_3.Message])
ln = Line(StartPoint=hops_2.Pt_i, EndPoint=hops_2.Pt_r)
panel_2 = Panel("C:\Users\SP\AppData\Roaming\McNeel\Rhinoceros\7.0\Localization\en-US\Render Content\")
panel_3 = Panel(hops_2.Readme)
concat = Concatenate(FragmentA=panel_2, FragmentB="Wood\Pine\Maritime pine.rmtl")
bois = ColourSwatch(SwatchColor=RGB(143, 134, 117))
timber_lines = Colour(bois)
timber = Data(concat)

number = Number(profondeurs)
Z_2 = UnitZ(Factor=expr("-x", number))
gradient = Gradient(
    LowerLimit="0",
    UpperLimit="8",
    Parameter=number,
    stops=[0.0102: RGB(0, 0, 0), 0.521: RGB(80, 55, 25), 1: RGB(165, 42, 42)])
extr_2 = Extrude(Base=terre, Direction=Z_2)

cap = CapHoles(Brep=extr_2)
alpha = AdjustAlpha(Color=gradient, Alpha="0.1")

preview = CustomPreview(Geometry=cap, Material=alpha)
